# Dynamo graph ExampleRemote.dyn (Dynamo 0.9.1.3872)

# group: FLUX IO
flux_projects = FluxProjects()
select_project = FluxSelector(flux_projects)  # 1 picked in the model
data_keys = FluxProjectKeys(select_project)
select_key = FluxSelector(data_keys)  # 1 picked in the model
flow_control = FluxModeSwitcher()  # 1 picked in the model
from_flux = FromFlux(select_key, flow_control)  # 1 picked in the model
design_vector_value_filter = Python(IN[0]=from_flux)
# ---------- design_vector_value_filter.python (12 lines) ----------
import clr
clr.AddReference('ProtoGeometry')
from Autodesk.DesignScript.Geometry import *
#The inputs to this node will be stored as a list in the IN variables.
dataEnteringNode = IN

vals=[]
for designParam in IN[0]:
	vals.append(designParam[1])

#Assign your output to the OUT variable.
OUT = vals
# ----------------------------------------

# group: Parameter Expander
design_vector_expander = CodeBlock(l=design_vector_value_filter) { l[0]; l[1]; }

# group: Design Model
byRadiusHeight = Cylinder.ByRadiusHeight(arg1=design_vector_expander.out0, arg2=design_vector_expander.out1)

# group: FLUX IO
flux_projects_2 = FluxProjects()
select_project_2 = FluxSelector(flux_projects_2)  # 1 picked in the model
data_keys_2 = FluxProjectKeys(select_project_2)
select_key_2 = FluxSelector(data_keys_2)  # 1 picked in the model
flow_control_2 = FluxModeSwitcher()  # 1 picked in the model
to_flux = ToFlux(select_key_2, flow_control_2, byRadiusHeight)
