# Grasshopper definition hysteresis-remote.ghx (Grasshopper 0.9.76)
# plug-ins: Python Interpreter, Flux

flow_control = FlowControl({"Once", "Constantly"}, selected="Constantly")
flux = FluxProject(project="a9jAyvE70YL3qR5WZ")  # -> Keys, Meta
from_flux = FromFlux(
    Keys=flux.Keys,
    Mode=flow_control,
    keyId="40125174d928b38689aec28fc8e6e8ed",
    mode="Constantly",
    Branch0_Path="{0}",
    Branch0_Item0_null_string=False,
    Branch0_Item0_string="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",
    Branch0_Item0_TypeName="Grasshopper.Kernel.Types.GH_String")  # -> Value, Meta
to_flux = ToFlux(Keys=flux.Keys, Mode=flow_control, keyId="40cb7ce2f54c0b988a90e04600d8d638", mode="Constantly")  # disabled
placexmlsnippet = CSharpScript(x=from_flux.Value)  # -> out, A; inputs x: String
# ---------- placexmlsnippet: C# ----------
    string xmlSnippet = x;
    ClearCanvas();
    System.Windows.Forms.Clipboard.SetText(xmlSnippet);
    Paste();
# ---------- placexmlsnippet: C# additional code ----------
  void ClearCanvas(){
    GH_DocumentIO docIO = new GH_DocumentIO(GrasshopperDocument);
    List<IGH_DocumentObject> objectsToKeep = new List<IGH_DocumentObject>();
    List<IGH_DocumentObject> objectsToClear = new List<IGH_DocumentObject>();
    Grasshopper.Kernel.Special.GH_Group grp = new Grasshopper.Kernel.Special.GH_Group();

    foreach(IGH_DocumentObject obj in GrasshopperDocument.Objects){ //for all objs in GH doc

      if(obj is Grasshopper.Kernel.Special.GH_Group){ //if it's a group
        grp = obj as Grasshopper.Kernel.Special.GH_Group;
        //if the group contains this script, add those objects to the objectsToKeep list
        if(grp.Objects().Exists(x => x.InstanceGuid == this.Component.InstanceGuid)){
          objectsToKeep.Add(obj);
          foreach(IGH_DocumentObject grpObj in grp.Objects()){ // for all the objects in the group
            objectsToKeep.Add(grpObj);
          }
        }
      }
      //start objectsToClear list with all objects
      objectsToClear = GrasshopperDocument.Objects.ToList();
    }
    //remove objectsToKeep from objectsToClear
    foreach(IGH_DocumentObject obj in objectsToKeep){
      objectsToClear.Remove(obj);
    }
    //delete remaining items
    foreach(IGH_DocumentObject obj in objectsToClear){
      GrasshopperDocument.Objects.Remove(obj);
    }

  } 
  
  void Paste(){
    GH_DocumentIO documentIO = new GH_DocumentIO();
    documentIO.Paste(GH_ClipboardType.System);
    var thispivot = this.Component.Attributes.Pivot;

    int smallestX = Int32.MaxValue;
    int smallestY = Int32.MaxValue;
    foreach(IGH_DocumentObject obj in documentIO.Document.Objects){
      var pivot = obj.Attributes.Pivot;
      if(pivot.X < smallestX) smallestX = (int) pivot.X;
      if(pivot.Y < smallestY) smallestY = (int) pivot.Y;
    }

    System.Drawing.Size offset = new System.Drawing.Size((int) thispivot.X - smallestX, (int) thispivot.Y - smallestY);

    documentIO.Document.TranslateObjects(offset, false);
    documentIO.Document.SelectAll();
    documentIO.Document.ExpireSolution();
    documentIO.Document.MutateAllIds();
    System.Collections.Generic.IEnumerable<IGH_DocumentObject> objs = documentIO.Document.Objects;
    GrasshopperDocument.DeselectAll();
    GrasshopperDocument.MergeDocument(documentIO.Document);
    GrasshopperDocument.UndoUtil.RecordAddObjectEvent("Paste", objs);
    //  documentIO.ClearClipboard(GH_ClipboardType.System);
    GrasshopperDocument.ScheduleSolution(10);
    List<IGH_DocumentObject> myDisabledObj = new List<IGH_DocumentObject>();
    myDisabledObj = GrasshopperDocument.DisabledObjects();

  }
# ---------- end placexmlsnippet ----------
from_flux_2 = FromFlux(
    Keys=flux.Keys,
    Mode=flow_control,
    keyId="4082566f6a4c3b9b7b26701fdb4b1c3b",
    mode="Constantly",
    Branch0_Path="{0}",
    Branch0_Item0_null_string=False,
    Branch0_Item0_string="""VDoguscan_3L
p0
.""",
    Branch0_Item0_TypeName="Grasshopper.Kernel.Types.GH_String")  # -> Value, Meta
from_flux_3 = FromFlux(
    Keys=flux.Keys,
    Mode=flow_control,
    keyId="404722a83a22684e0079a179785efa64",
    mode="Constantly",
    Branch0_Path="{0;0;0}",
    Branch0_Item0_null_string=False,
    Branch0_Item0_string="""(lp0
F5.0
a.""",
    Branch0_Item0_TypeName="Grasshopper.Kernel.Types.GH_String",
    Branch0_Item1_null_string=False,
    Branch0_Item1_string="""(lp0
F90.0
a.""",
    Branch0_Item1_TypeName="Grasshopper.Kernel.Types.GH_String",
    Branch0_Item2_null_string=False,
    Branch0_Item2_string="""(lp0
F16.0
aF-1.0
a.""",
    Branch0_Item2_TypeName="Grasshopper.Kernel.Types.GH_String",
    Branch0_Item3_null_string=False,
    Branch0_Item3_string="""(lp0
F0.0
a.""",
    Branch0_Item3_TypeName="Grasshopper.Kernel.Types.GH_String",
    Branch0_Item4_null_string=False,
    Branch0_Item4_string="""(lp0
F90.0
a.""",
    Branch0_Item4_TypeName="Grasshopper.Kernel.Types.GH_String",
    Branch0_Item5_null_string=False,
    Branch0_Item5_string="""(lp0
F4.0
a.""",
    Branch0_Item5_TypeName="Grasshopper.Kernel.Types.GH_String",
    Branch0_Item6_null_string=False,
    Branch0_Item6_string="""(lp0
F8.0
a.""",
    Branch0_Item6_TypeName="Grasshopper.Kernel.Types.GH_String",
    Branch0_Item7_null_string=False,
    Branch0_Item7_string="""(lp0
F2.0
a.""",
    Branch0_Item7_TypeName="Grasshopper.Kernel.Types.GH_String",
    Branch0_Item8_null_string=False,
    Branch0_Item8_string="""(lp0
F12.0
a.""",
    Branch0_Item8_TypeName="Grasshopper.Kernel.Types.GH_String"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)  # -> Value, Meta
from_flux_4 = FromFlux(
    Keys=flux.Keys,
    Mode=flow_control,
    keyId="40b8bce9d56129e52fe444d295fc9af4",
    mode="Constantly",
    Branch0_Path="{0;0}",
    Branch0_Item0_number=8,
    Branch0_Item0_TypeName="Grasshopper.Kernel.Types.GH_Integer")  # -> Value, Meta
from_flux_5 = FromFlux(
    Keys=flux.Keys,
    Mode=flow_control,
    keyId="40fc6dc0a9c8f0442f6624b91b6640f1",
    mode="Constantly",
    Branch0_Path="{0;0;0}",
    Branch0_Item0_null_string=False,
    Branch0_Item0_string="""VB_P1_Index
p0
.""",
    Branch0_Item0_TypeName="Grasshopper.Kernel.Types.GH_String",
    Branch0_Item1_null_string=False,
    Branch0_Item1_string="""Vparam01_2NDLevelHeight
p0
.""",
    Branch0_Item1_TypeName="Grasshopper.Kernel.Types.GH_String",
    Branch0_Item2_null_string=False,
    Branch0_Item2_string="""VM_P3_Index
p0
.""",
    Branch0_Item2_TypeName="Grasshopper.Kernel.Types.GH_String",
    Branch0_Item3_null_string=False,
    Branch0_Item3_string="""VParam04_DisplacementRange
p0
.""",
    Branch0_Item3_TypeName="Grasshopper.Kernel.Types.GH_String",
    Branch0_Item4_null_string=False,
    Branch0_Item4_string="""Vparam01_1STLevelHeight
p0
.""",
    Branch0_Item4_TypeName="Grasshopper.Kernel.Types.GH_String",
    Branch0_Item5_null_string=False,
    Branch0_Item5_string="""VT_P5_Index
p0
.""",
    Branch0_Item5_TypeName="Grasshopper.Kernel.Types.GH_String",
    Branch0_Item6_null_string=False,
    Branch0_Item6_string="""VM_P2_Index
p0
.""",
    Branch0_Item6_TypeName="Grasshopper.Kernel.Types.GH_String",
    Branch0_Item7_null_string=False,
    Branch0_Item7_string="""VB_P5_Index
p0
.""",
    Branch0_Item7_TypeName="Grasshopper.Kernel.Types.GH_String",
    Branch0_Item8_null_string=False,
    Branch0_Item8_string="""VT_P4_Index
p0
.""",
    Branch0_Item8_TypeName="Grasshopper.Kernel.Types.GH_String"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)  # -> Value, Meta
deserialize = PythonScript(input=from_flux_3.Value)  # -> output
# ---------- deserialize: Python ----------
import cPickle
output = cPickle.loads(input)
print output
print(type(output))
# ---------- end deserialize ----------
deserialize_2 = PythonScript(input=from_flux_5.Value)  # -> output; same code as deserialize
deserialize_3 = PythonScript(input=from_flux_2.Value)  # -> output; same code as deserialize
tree2list = PythonScript(intree=deserialize)  # -> outlist; inputs intree: tree
# ---------- tree2list: Python ----------
myList=[]
for i in range(intree.BranchCount):
    arr1 = []
    for j in range(len(intree.Branch(i))):
        arr1.append(intree.Branch(i)[j])
    myList.append(arr1)
    
outlist = myList
print outlist
# ---------- end tree2list ----------
cartesianproduct = PythonScript(kernel=tree2list)  # -> cproduct; inputs kernel: list
# ---------- cartesianproduct: Python ----------
import itertools
import cPickle

def generate_cproduct(matrix):
    #cartesian product
    product = []
    for item in itertools.product(*matrix):
        product.append(item)
    return product

cproduct = generate_cproduct(kernel)
print kernel
# ---------- end cartesianproduct ----------
panel = Panel(deserialize_3)
getdirectory = PythonScript()  # -> dir, file_name, full_path
# ---------- getdirectory: Python ----------
import os
fn = ghenv.Component.OnPingDocument()
file_name = (str(fn)).strip("*")
print file_name

full_path = (ghenv.Component.OnPingDocument().FilePath)

dir = full_path.replace(file_name+".ghx","")
print dir
print full_path
# ---------- end getdirectory ----------
panel_2 = Panel("MyCluster")
c_script = CSharpScript(Cluster=deserialize_3, Output="output")  # -> out, Data; inputs Cluster: String, Output: String; disabled
# ---------- c_script: C# ----------
    RegisterSolutionStartEvent();

    IGH_Param parameter = FindParameter(Cluster, Output);
    if (parameter == null)
    {
      Print("No such cluster+parameter could be found");
      return;
    }

    Data = HarvestData(parameter);
# ---------- c_script: C# additional code ----------
  private bool _registered = false;

  private void RegisterSolutionStartEvent()
  {
    if (_registered)
      return;

    _registered = true;
    GrasshopperDocument.SolutionStart += Document_SolutionStart;
  }

  private void Document_SolutionStart(object sender, EventArgs e)
  {
    // TODO: figure out whether the cluster we're supposed to be watching
    //       has expired. If so, then we need to expire this component as well.
    
    Component.ExpireSolution(false);
  }
  private IGH_Param FindParameter(string clusterName, string outputName)
  {
    // Iterate over all objects in the document.
    foreach (IGH_DocumentObject obj in GrasshopperDocument.Objects)
    {
      // Make sure nickname matches.
      if (!string.Equals(clusterName, obj.NickName, StringComparison.Ordinal))
        continue;

      // Make sure object is a cluster.
      Grasshopper.Kernel.Special.GH_Cluster cluster = obj as Grasshopper.Kernel.Special.GH_Cluster;
      if (obj == null)
        continue;

      // Iterate over all output parameters.
      foreach (IGH_Param output in cluster.Params.Output)
        if (string.Equals(output.NickName, outputName, StringComparison.Ordinal))
          return output;
    }

    return null;
  }
  private DataTree<object> HarvestData(IGH_Param parameter)
  {
    // Make sure the cluster has been solved.
    Grasshopper.Kernel.Special.GH_Cluster cluster =
      parameter.Attributes.Parent.DocObject as Grasshopper.Kernel.Special.GH_Cluster;
    if (cluster == null)
      return null;

    if (cluster.Phase != GH_SolutionPhase.Computed)
    {
      cluster.CollectData();
      cluster.ComputeData();
    }

    IGH_Structure tree = parameter.VolatileData;
    if (tree == null)
    {
      Print("Parameter contains no data.");
      return null;
    }

    DataTree<object> newTree = new DataTree<object>();
    newTree.MergeStructure(tree, null);
    return newTree;
  }
# ---------- end c_script ----------
c_script_2 = CSharpScript(Cluster=deserialize_3, Output="R")  # -> out, Data; inputs Cluster: String, Output: String; disabled; same code as c_script
from_flux_6 = FromFlux(
    Keys=flux.Keys,
    Mode=flow_control,
    keyId="4006faa082ee097903a6e99e6db4516a",
    mode="Constantly",
    Branch0_Path="{0}",
    Branch0_Item0_null_string=False,
    Branch0_Item0_string="recorded",
    Branch0_Item0_TypeName="Grasshopper.Kernel.Types.GH_String")  # -> Value, Meta
selector = PythonScript(input=cartesianproduct, keys=deserialize_2, index=from_flux_4.Value, node_name=deserialize_3, mode=from_flux_6.Value)  # -> out, node, alt; inputs input: list, keys: list
# ---------- selector: Python ----------
import cPickle
def get_alt(index, productlist,keys):
    i = int(index)%(len(productlist)) 
    selection = productlist[i]    
    rvec = dict()    
    nkeylist = []
    for key in keys:
        nkeylist.append(key)
    for key,value in zip(nkeylist,selection):
        rvec[key] = value
    return rvec

def update_model(rvec, node):
    for input in node.Params.Input:
        print rvec
        value = rvec[input.NickName]
        input.Sources[0].Slider.Value = value
    node.ExpireSolution(True)
    print "Updated "+node.NickName
    
def get_node(name):
    ghObjects = ghenv.Component.OnPingDocument().Objects
    for obj in ghObjects:
        if obj.NickName == name:
            return obj
    print "Node not found"
    
node = get_node(node_name)
_alt = get_alt(index, input, keys)
print _alt
if mode == "recorded":
    update_model(_alt, node)
    alt = cPickle.dumps(_alt)
    print _alt
    print alt
else:
    alt = None
# ---------- end selector ----------
grabnodeoutput = PythonScript(node=selector.node)  # -> result; disabled
# ---------- grabnodeoutput: Python ----------
print node.NickName
outputList = []
#for output in node.Params.Output:
#    outputList.append(output)
    
#result = outputList
#meh
result = node.Params.Output[0]
print result
#print outputList
# ---------- end grabnodeoutput ----------
to_flux_2 = ToFlux(Keys=flux.Keys, Value=c_script.Data, Mode=flow_control, keyId="40e273591a581a702b10445b1567f97b", mode="Constantly")  # disabled
from_flux_7 = FromFlux(
    Keys=flux.Keys,
    Mode=flow_control,
    keyId="403b08d4ea68137ba11c4286c4962062",
    mode="Constantly",
    Branch0_Path="{0;0}",
    Branch0_Item0_null_string=False,
    Branch0_Item0_string="N.",
    Branch0_Item0_TypeName="Grasshopper.Kernel.Types.GH_String")  # -> Value, Meta
to_flux_3 = ToFlux(Keys=flux.Keys, Value=c_script_2.Data, Mode=flow_control, keyId="40eb4de7d220ebd98aef0ffb841f45d5", mode="Constantly")  # disabled
deserialize_4 = PythonScript(input=from_flux_7.Value)  # -> output; same code as deserialize
tree2list_2 = PythonScript()  # -> out, outlist; inputs intree: tree
# ---------- tree2list_2: Python ----------
outlist = []
for i in range(intree.BranchCount):
    print intree.Branch(i)
    outlist.append(intree.Branch(i))
# ---------- end tree2list_2 ----------
kernel2product = PythonScript(
    data=deserialize_4,
    node_name=panel,
    dir=getdirectory.dir,
    full_path=getdirectory.full_path,
    index=from_flux_4.Value,
    mode=from_flux_6.Value)  # -> alt
# ---------- kernel2product: Python ----------
import json
import itertools
import Grasshopper as gh
from System import Guid
from scriptcontext import doc
import os
import time
import Rhino
import rhinoscriptsyntax as rs
import cPickle

gh = Rhino.RhinoApp.GetPlugInObject("Grasshopper")

#rs.EnableRedraw(True)

pardir = os.path.abspath(os.path.join(dir, os.pardir))
path = os.path.join(pardir,"gallery"+os.sep)
print path
pardir2 = os.path.abspath(os.path.join(path, os.pardir))
path_kernel = os.path.join(pardir2, "received"+os.path.sep)
print path_kernel
keylist = []
valuelist = []

def create_flipdict(data):
    veclist = []
    # turn strings into dicts
    for item in data:
        vec = eval(item)
        veclist.append(vec)
    
    flipdict = dict()    
    # get the names of keys to iterate over 
    for vec in veclist:   
        for key in vec:
            flipdict[key] = []
    
    #accumulate
    for key in flipdict:
        for vec in veclist:
            if key in vec:
                flipdict[key].append(vec[key])
    return flipdict                

def create_matrix(flipdict):
        
    #create matrix 
    matrix = []       
    for key in flipdict:
        matrix.append(set(flipdict[key]))
    return matrix

def generate_cproduct(matrix):
    #cartesian product
    product = []
    for item in itertools.product(*matrix):
        product.append(item)
    return product

def get_alt(index, productlist,flipdict):
    i = int(index)%(len(productlist)) 
    selection = productlist[i]    
    rvec = dict()    
    nkeylist = []
    for key in flipdict:
        nkeylist.append(key)
    for key,value in zip(nkeylist,selection):
        rvec[key] = value
    return rvec

def update_model(rvec, node):
    for input in node.Params.Input:
        value = rvec[input.NickName]
        input.Sources[0].Slider.Value = value
    node.ExpireSolution(False)
    print "Updated "+node.NickName
    
def get_node(name):
    ghObjects = ghenv.Component.OnPingDocument().Objects
    for obj in ghObjects:
        if obj.NickName == name:
            return obj
    print "Node not found"
#def captureView(uid):
#    bmp = view.CaptureToBitmap(False, False, False)
#    bmp.Save(path+uid+".bmp")       

#def send_to_gallery(data,send):
#    if send:
#        json_data = dict()
#    
#        uid = str(Guid.NewGuid())
#        json_data['params'] = data
#        json_data['uid'] = uid
#        json_data['cad_file'] = 'xyz.obj'
#        json_data['image'] = uid+'.bmp'
#        captureView(uid)
##        bitmap = doc.Views.ActiveView.CaptureToBitmap(True, True, True)
##        bitmap.Save(path+uid+'.bmp')
#        with open(path+uid+'.json','w') as outfile:
#            json.dump(json_data, outfile, indent=2)
#        print "Sent "+uid+" to gallery"       





# Generate cart. prod. from new kernel and slowly send to gallery
node = get_node(node_name)
# Read file

# parse the data into dict
kernel = json.loads(data)
print kernel
            
_matrix = create_matrix(kernel)
_cproduct = generate_cproduct(_matrix)

if mode == "gallery":
    _alt = get_alt(index , _cproduct, kernel)
    update_model(_alt,node)
    alt = cPickle.dumps(_alt)
    print alt
else:
    alt = None
    print alt
# ---------- end kernel2product ----------
nonnull = PythonScript(input0=selector.alt, input1=kernel2product)  # -> a; inputs input1: tree
# ---------- nonnull: Python ----------
if not input0 == None:
    a = input0
else:
    a = input1
    
print a
# ---------- end nonnull ----------
to_flux_4 = ToFlux(Keys=flux.Keys, Value=nonnull, Mode=flow_control, keyId="408642bb36ad94d34f040012d21f4c92", mode="Constantly")

param01_1stlevelheight = Slider(90, range=50..200)
m_p3_index = Slider(-1, range=-1..24)
b_p2_index = Slider(0, range=-1..24)
b_p3_index = Slider(6, range=-1..24)
b_p4_index = Slider(16, range=-1..24)
param03_linemergingtreshold = Slider(15, range=10..18)
param01_2ndlevelheight = Slider(90, range=50..200)
param02_gridcount = Slider(5, range=0..10)
t_p1_index = Slider(1, range=-1..15)
t_p2_index = Slider(3, range=-1..24)
t_p3_index = Slider(6, range=-1..24)
t_p4_index = Slider(12, range=-1..24)
m_p1_index = Slider(1, range=-1..24)
m_p2_index = Slider(8, range=-1..24)
m_p4_index = Slider(22, range=-1..24)
b_p1_index = Slider(5, range=-1..24)
param04_displacementrange = Slider(0, range=0..10)
t_p5_index = Slider(4, range=-1..24)
m_p5_index = Slider(23, range=-1..24)
b_p5_index = Slider(2, range=-1..24)
doguscan_3l = Doguscan_3L(
    num_18=param01_1stlevelheight,
    num_19=param01_2ndlevelheight,
    num_20=param02_gridcount,
    num=t_p1_index,
    num_3=t_p2_index,
    num_5=t_p3_index,
    num_7=t_p4_index,
    num_9=t_p5_index,
    num_2=m_p1_index,
    num_4=m_p2_index,
    num_6=m_p3_index,
    num_8=m_p4_index,
    num_12=m_p5_index,
    num_10=b_p1_index,
    num_13=b_p2_index,
    num_14=b_p3_index,
    num_16=b_p4_index,
    num_17=b_p5_index,
    num_11=param03_linemergingtreshold,
    num_15=param04_displacementrange)  # -> data_2, geo_2
flux_2 = FluxProject(project="a9jAyvE70YL3qR5WZ")  # -> Keys, Meta
flow_control_2 = FlowControl({"Once", "Constantly"}, selected="Constantly")
to_flux_5 = ToFlux(Keys=flux_2.Keys, Mode=flow_control_2, keyId="40e273591a581a702b10445b1567f97b", mode="Constantly")
to_flux_6 = ToFlux(Keys=flux_2.Keys, Mode=flow_control_2, keyId="40eb4de7d220ebd98aef0ffb841f45d5", mode="Constantly")

# ==== cluster Doguscan_3L
num = ClusterInput()
num_2 = ClusterInput()
num_3 = ClusterInput()
num_4 = ClusterInput()
num_5 = ClusterInput()
num_6 = ClusterInput()
num_7 = ClusterInput()
num_8 = ClusterInput()
num_9 = ClusterInput()
num_10 = ClusterInput()
num_11 = ClusterInput()
num_12 = ClusterInput()
num_13 = ClusterInput()
num_14 = ClusterInput()
num_15 = ClusterInput()
num_16 = ClusterInput()
num_17 = ClusterInput()
num_18 = ClusterInput()
num_19 = ClusterInput()
num_20 = ClusterInput()
num_21 = Number(num)
num_22 = Number(num_2)
num_23 = Number(num_3)
num_24 = Number(num_4)
num_25 = Number(num_5)
num_26 = Number(num_6)
num_27 = Number(num_7)
num_28 = Number(num_8)
num_29 = Number(num_9)
num_30 = Number(num_10)
num_31 = Number(num_11)
num_32 = Number(num_12)
num_33 = Number(num_13)
num_34 = Number(num_14)
num_35 = Number(num_15)
num_36 = Number(num_16)
num_37 = Number(num_17)
num_38 = Number(num_18)
num_39 = Number(num_19)
num_40 = Number(num_20)
num_41 = Number([num_22, num_24, num_26, num_28, num_32])
num_42 = Number([num_30, num_33, num_34, num_36, num_37])
num_43 = Number([num_25, num_23, num_21, num_27, num_29])
vector_xyz = VectorXYZ(XComponent=0, YComponent=0, ZComponent=num_39)  # -> Vector, Length
chosen_points_s_indices_for_line_creatio = Number(num_43)  # "Chosen points's indices for line creation"
chosen_points_s_indices_for_line_creatio_2 = Number(num_41)  # "Chosen points's indices for line creation"
number_slider = Slider(20, range=0..100)

multiplication = Multiplication(A=num_40, B=number_slider)
division = Division(A=multiplication, B=2)
vector_xyz_2 = VectorXYZ(XComponent=division, YComponent=division, ZComponent=0)  # -> Vector, Length
construct_point = ConstructPoint(XCoordinate=0, YCoordinate=0, ZCoordinate=num_38)
vector_xyz_3 = VectorXYZ(XComponent=0, YComponent=0, ZComponent=0)  # -> Vector, Length
move = Move(Geometry=construct_point, Motion=vector_xyz_3.Vector)  # -> Geometry, Transform
reverse = Reverse(Vector=vector_xyz_2.Vector)

move_2 = Move(Geometry=move.Geometry, Motion=vector_xyz.Vector)  # -> Geometry, Transform
bottombase = Point(vector_xyz_3.Vector)
midbase = Point(move.Geometry)
topbase = Point(move_2.Geometry)
top_level_base_point_of_grid = Point(topbase)
number_slider_2 = Slider(4, range=0..100)
number_slider_3 = Slider(4, range=0..100)
base_point_of_grid = Point(midbase)
number_slider_4 = Slider(4, range=0..10)
base_point_of_grid_2 = Point(bottombase)
number_slider_5 = Slider(4, range=0..10)
chosen_points_s_indices_for_line_creatio_3 = Number(num_42)  # "Chosen points's indices for line creation"
lng = ListLength(List=[chosen_points_s_indices_for_line_creatio_2, chosen_points_s_indices_for_line_creatio_3, chosen_points_s_indices_for_line_creatio])
number_slider_6 = Slider(4, range=0..10)
lng_2 = ListLength(List=chosen_points_s_indices_for_line_creatio)
lng_3 = ListLength(List=chosen_points_s_indices_for_line_creatio_2)
lng_4 = ListLength(List=chosen_points_s_indices_for_line_creatio_3)
neg = Negative(Value=num_35)
multiplication_2 = Multiplication(A=lng, B=2)
addition = Addition(A=lng_2, B=lng_3)
vb = VBScript(Genelist="Metaball Radii", Count=multiplication_2, MinVal=num_35, MaxVal=neg, DecimalPlaces=Slider(2, range=0..3))  # -> out
# ---------- vb: VB ----------
    For Each obj As IGH_DocumentObject In owner.OnPingDocument().Objects
      If (obj.ComponentGuid <> New Guid("{21553c44-ea62-475e-a8bb-62b2a3ee5ca5}")) Then
        Continue For
      Else
        If (obj.NickName Like genelist) Then
          CallByName(obj, "Count", CallType.Set, count)
          CallByName(obj, "Minimum", CallType.Set, MinVal)
          CallByName(obj, "Maximum", CallType.Set, MaxVal)
          CallByName(obj, "Decimals", CallType.Set, DecimalPlaces)
          If Randomize = True Then
            For idx As int32 = 0 To Count - 1
              Dim Dom As New Interval(MinVal, MaxVal)
              CallByName(obj, "Value", CallType.Set, idx, Dom.ParameterAt(Rnd()))
            Next idx
          End If
          CallByName(obj, "ExpireSolution", CallType.Method, True)
        End If
      End If
    Next
# ---------- end vb ----------
multiplication_3 = Multiplication(A=lng_2, B=2)
panel = Panel(chosen_points_s_indices_for_line_creatio)
panel_2 = Panel(chosen_points_s_indices_for_line_creatio_2)
panel_3 = Panel(chosen_points_s_indices_for_line_creatio_3)
multiplication_4 = Multiplication(A=addition, B=2)
metaball_radii = GenePool(
    Decimals=2,
    Maximum=0,
    Minimum=0,
    Value=[0, 0, 0, 0, 0, 0, 0, 0, 0, 0, 0, 0, 0, 0, 0, 0, 0, 0, 0, 0, 0, 0, 0, 0, 0, 0, 0, 0, 0, 0])
series = Series(Start=0, Step=2, Count=lng_2)
series_2 = Series(Start=multiplication_3, Step=2, Count=lng_3)
addition_2 = Addition(A=series, B=1)
series_3 = Series(Start=multiplication_4, Step=2, Count=lng_4)
addition_3 = Addition(A=series_2, B=1)
addition_4 = Addition(A=series_3, B=1)
item = ListItem(List=metaball_radii, Index=addition_3, Wrap=True)
item_2 = ListItem(List=metaball_radii, Index=series_3, Wrap=True)
item_3 = ListItem(List=metaball_radii, Index=series, Wrap=True)
item_4 = ListItem(List=metaball_radii, Index=series_2, Wrap=True)
item_5 = ListItem(List=metaball_radii, Index=addition_4, Wrap=True)
item_6 = ListItem(List=metaball_radii, Index=addition_2, Wrap=True)
x_displacement_2_values = Number(item_3)
x_displacement_2 = Number(x_displacement_2_values)
panel_4 = Panel(x_displacement_2)
y_displacement_2_values = Number(item_6)
y_displacement_2 = Number(y_displacement_2_values)
panel_5 = Panel(y_displacement_2)
top_level_curve_generation_system = TopLevelCurveGenerationSystem(
    G=top_level_base_point_of_grid,
    X=number_slider,
    X_2=num_40,
    Y=num_40,
    z_component=Slider(19, range=0..100),
    num=panel,
    x_displacement2=panel_4,
    y_displacement_2=panel_5)  # -> start, end, G_3, G_2, Q, i
bottom_points = Point(flatten(top_level_curve_generation_system.end))
top_points = Point(flatten(top_level_curve_generation_system.start))
crv = Curve(flatten([top_level_curve_generation_system.G_2, top_level_curve_generation_system.Q]))
x_displacement_1_values = Number(item_4)
x_displacement_1 = Number(x_displacement_1_values)
panel_6 = Panel(x_displacement_1)
y_displacement_1_values = Number(item)
y_displacement_1 = Number(y_displacement_1_values)
panel_7 = Panel(y_displacement_1)
mid_level_curve_generation_system = MidLevelCurveGenerationSystem(
    G=base_point_of_grid,
    X=Slider(20, range=0..20),
    number=num_40,
    number_2=num_40,
    z_component=Slider(22, range=0..100),
    num=panel_2,
    X_2=panel_6,
    Y=panel_7)  # -> G_2, start, end, i, G_3
cluster = Cluster(points=flatten(mid_level_curve_generation_system.start))
start_points = Point(flatten(mid_level_curve_generation_system.end))
top_points_2 = Point(flatten(mid_level_curve_generation_system.start))
crv_2 = Curve(flatten(mid_level_curve_generation_system.G_3))
x_displacement_3_values = Number(item_2)
x_displacement_3 = Number(x_displacement_3_values)
panel_8 = Panel(x_displacement_3)
y_displacement_3_values = Number(item_5)
y_displacement_3 = Number(y_displacement_3_values)
panel_9 = Panel(y_displacement_3)
bottom_level_curve_generation_system = BottomLevelCurveGenerationSystem(
    G=base_point_of_grid_2,
    X=Slider(20, range=0..20),
    X_2=num_40,
    Y=num_40,
    z_component=Slider(22, range=0..100),
    num=panel_3,
    X_3=panel_8,
    Y_2=panel_9)  # -> G_2, start, end, i, G_3
start_points_2 = Point(flatten(bottom_level_curve_generation_system.end))
top_points_3 = Point(flatten(bottom_level_curve_generation_system.start))
crv_3 = Curve(flatten(bottom_level_curve_generation_system.G_3))
pt = Point(cluster)
pt_2 = Point([mid_level_curve_generation_system.G_2, top_level_curve_generation_system.G_3, bottom_level_curve_generation_system.G_2])
cps = ClosestPoints(Point=bottom_points, Cloud=top_points_2, Count=Slider(3, range=0..10))  # -> graft(ClosestPoint), CPIndex, Distance
cps_2 = ClosestPoints(Point=top_points_3, Cloud=start_points, Count=Slider(3, range=0..10))  # -> graft(ClosestPoint), CPIndex, Distance
ln = Line(StartPoint=flatten(bottom_points), EndPoint=cps.ClosestPoint)  # -> flatten(Line)
ln_2 = Line(StartPoint=flatten(top_points_3), EndPoint=cps_2.ClosestPoint)  # -> flatten(Line)
dupln = RemoveDuplicateLines(Lines=ln, Tolerance=0.01)  # -> flatten(UniqueLines)
dupln_2 = RemoveDuplicateLines(Lines=ln_2, Tolerance=0.01)  # -> flatten(UniqueLines)
total_network_of_curves = Curve([dupln, crv_3, crv, dupln_2, crv_2])
topo = Topologizer(
    LinesInput=total_network_of_curves,
    FixPoints=[start_points_2, top_points, bottom_points, top_points_3, top_points_2, start_points],
    Tolerance=num_31)  # -> flatten(L), P, S, E, N, I, O, G
number_slider_7 = Slider(3, range=0..10)
crv_4 = Curve(topo.L)
line_to_mesh = ExoWireframe(
    Lines=crv_4,
    Sides=Slider(12, range=0..100),
    StartRadius=number_slider_7,
    EndRadius=number_slider_7,
    NodeDepth=Slider(0, range=0..10),
    Division=Slider(20, range=0..1000),
    Open=False)
lng_5 = ListLength(List=crv_4)
wblaplace = WeaverbirdsLaplacianSmoothing(MeshCurves=line_to_mesh, Level=Slider(4, range=0..10), SmoothNakedEdges=1, Thin=1)
number_ofnetworkcurves = Panel("NumberOfNetworkCurves")
levelm_indices = Panel("MLevel_Indices")
levelt_indices = Panel("TLevel_Indices")
levelb_indices = Panel("BLevel_Indices")
totalarea = Panel("TotalArea")
population = Panel("PotentialPopulation")
deflection = Panel("MaximumDeflection")
stress = Panel("AverageStressOnSkin(kn/m2)")
wboffset = WeaverbirdsOffsetMesh(MeshCurves=wblaplace, Distance=Slider(1.5, range=0..2), OffsetType=0)
mesh = Mesh(wboffset)
medges = MeshEdges(Mesh=mesh)  # -> NakedEdges, InteriorEdges, NonManifoldEdges
geo = Geometry(mesh)
vec = VectorXYZ(XComponent=Slider(120, range=0..1000), YComponent=0, ZComponent=0)  # -> Vector, Length
vector_xyz_4 = VectorXYZ(XComponent=0, YComponent=0, ZComponent=2)  # -> Vector, Length
calculatearea = BooleanToggle(True)
geo_2 = ClusterOutput(geo)
cull = CullPattern(List=wboffset, CullPattern=calculatearea)
contour = Contour(Shape=cull, Point=vector_xyz_4.Vector, Direction=Vector(0, 0, 1), Distance=Slider(1, range=0..100))
vec_2 = VectorXYZ(XComponent=0, YComponent=0, ZComponent=0.1)  # -> Vector, Length; disabled
extr = Extrude(Base=contour, Direction=vec_2.Vector)  # disabled
area = Area(Geometry=contour)  # -> flatten(Area), Centroid
cap = CapHoles(Brep=extr)  # disabled
people_per_m2 = Slider(8, range=0..10)
mass_addition = MassAddition(Input=area.Area)  # -> flatten(Result), PartialResults
multiplication_5 = Multiplication(A=mass_addition.Result, B=16)
totalarea_2 = Panel(multiplication_5)
division_2 = Division(A=totalarea_2, B=people_per_m2)
int = Integer(division_2)
number_of_occupants = Panel(int)

deflection_show_multiplier = Slider(20, range=0..20)
perfomstructuralanalysis = BooleanToggle(False)
mesh_2 = Mesh(mesh)
percentage = Panel("40")
item_7 = ListItem(List=start_points_2, Index=0, Wrap=True)
pdecon = Deconstruct(Point=item_7)  # -> XComponent, YComponent, ZComponent
addition_5 = Addition(A=pdecon.ZComponent, B=Slider(15, range=0..50))
mat = Material(MaterialType=5)
mat_2 = SupportType(X=True, Y=True, Z=True, RX=True, RY=True, RZ=True)

cull_2 = CullPattern(List=mesh_2, CullPattern=perfomstructuralanalysis)

reducemesh = CSharpScript(M=cull_2, P=percentage)  # -> out, A; inputs M: Mesh, P: Double
# ---------- reducemesh: C# ----------
    if(M != null){
      Guid meshObj = doc.Objects.AddMesh(M);
      doc.Objects.UnselectAll();
      doc.Objects.Select(meshObj);
      Rhino.RhinoApp.RunScript("_-ReduceMesh _ReductionPercentage " + Convert.ToString(P) + " _Enter", false);
      Rhino.DocObjects.RhinoObject MObj = doc.Objects.GetSelectedObjects(false, false).First();
      doc.Objects.Delete(meshObj, true);
      A = MObj.Geometry;
    }
# ---------- end reducemesh ----------
demesh = DeconstructMesh(Mesh=reducemesh.A)  # -> Vertices, Faces, Colours, Normals
pdecon_2 = Deconstruct(Point=demesh.Vertices)  # -> XComponent, YComponent, ZComponent
smaller = SmallerThan(FirstNumber=pdecon_2.ZComponent, SecondNumber=addition_5)  # -> SmallerThan, OrEqualTo
cull_3 = CullPattern(List=demesh.Vertices, CullPattern=smaller.SmallerThan)
femesh = FEMesh(Meshes=reducemesh.A, Material=mat, Thickness=Slider(1.1, range=0.1..10), AreaLoad=Vector(0, 0, 0), NormalAreaLoad=0)
fepointsupports = FEPointSupports(Point=cull_3, SupportType=mat_2)

fea_system = FEASystem(
    ModelComponents=flatten([femesh, fepointsupports]),
    IntersectAddedCurves=True,
    MergeTolerance=0.0001,
    MinimumCurveSpan=0.05,
    MaximumCurveSpan=10000,
    CurveTolerance=0.1)

fe_solver = FESolver(
    FEModel=fea_system,
    SelfWeightCoefficient=1,
    BeamOptimisationIterations=0,
    QuadOptimisationIterations=0,
    OptimizationTarget=0.3,
    OptimizationPenalization=2,
    LoadCase=0,
    AllCases=True)  # -> FEModel, MaxDeflection, Weight
division_3 = Division(A=deflection_show_multiplier, B=fe_solver.MaxDeflection)
mesh_visualization = MeshVisualization(FEModel=fe_solver.FEModel, Deflection=division_3, Plane=1, ShowThickness=False, ColorMode=1)  # -> Mesh, CompleteRange, VisibleRange
dedomain = DeconstructDomain(Domain=mesh_visualization.CompleteRange)  # -> Start, End
avr = Average(Input=flatten([dedomain.End, dedomain.Start]))
int_2 = Integer(avr)
maximum_deflection_m = Panel(fe_solver.MaxDeflection)
average_of_stress_range_kn_m2 = Panel(int_2)

data = Data([number_ofnetworkcurves, lng_5, levelb_indices, num_42, levelm_indices, num_41, levelt_indices, num_43, totalarea, multiplication_5, population, int, stress, int_2, deflection, maximum_deflection_m])
mesh_3 = Mesh(mesh_visualization.Mesh)
data_2 = ClusterOutput(data)
move_3 = Move(Geometry=[mesh_3, medges.InteriorEdges], Motion=vec.Vector)  # -> Geometry, Transform

# ==== cluster TopLevelCurveGenerationSystem
z_component = ClusterInput()
X = ClusterInput()
G = ClusterInput()
X_2 = ClusterInput()
Y = ClusterInput()
x_displacement2 = ClusterInput()
y_displacement_2 = ClusterInput()
vector_xyz = VectorXYZ(XComponent=0, YComponent=0, ZComponent=z_component)  # -> Vector, Length
number_slider = Slider(20, range=0..20)
num = ClusterInput()
x_displacement2_2 = Number(x_displacement2)
y_displacement_2_2 = Number(y_displacement_2)
rectangle = Rectangle(Plane=PlaneXY(0, 0, 0), XSize=X, YSize=X, Radius=0)  # -> Rectangle, Length
num_2 = Number(num)
arrrec = RectangularArray(Geometry=G, Cell=rectangle.Rectangle, XCount=X_2, YCount=Y)  # -> Geometry, Transform
list_item = ListItem(List=arrrec.Geometry, Index=graft(num_2), Wrap=False)
panel = Panel(num_2)
clean = CleanTree(RemoveNulls=True, RemoveInvalid=True, RemoveEmpty=True, Tree=list_item)
move = Move(Geometry=clean, Motion=vector_xyz.Vector)  # -> Geometry, Transform
vec = VectorXYZ(XComponent=x_displacement2_2, YComponent=y_displacement_2_2, ZComponent=0)  # -> Vector, Length
pt = Point(clean)
line = Line(StartPoint=move.Geometry, EndPoint=clean)  # -> flatten(Line)
move_2 = Move(Geometry=line, Motion=vec.Vector)  # -> Geometry, Transform
index = ItemIndex(List=arrrec.Geometry, Item=arrrec.Geometry)
vec_2 = VectorXYZ(XComponent=0, YComponent=0, ZComponent=Slider(25, range=0..100))  # -> Vector, Length
G_2 = ClusterOutput(move_2.Geometry)
end_points = EndPoints(Curve=move_2.Geometry)  # -> Start, End
tag = TextTag3D(
    Location=arrrec.Geometry,
    Text=index,
    Size=Slider(4, range=0..10),
    Colour=ColourSwatch(SwatchColor=RGB(0, 0, 0)),
    Justification=7)
top_points = Point(flatten(end_points.Start))
prox = Proximity3D(Points=top_points, Group=Slider(2, range=0..10))  # -> flatten(Links), Topology
item = ListItem(List=top_points, Index=prox.Topology, Wrap=True)
end = ClusterOutput(end_points.End)
start = ClusterOutput(end_points.Start)
G_3 = ClusterOutput(arrrec.Geometry)

end_2 = EndPoints(Curve=prox.Links)  # -> Start, End

pt_2 = Point(graft(end_2.Start))
pt_3 = Point(graft(end_2.End))
move_3 = Move(Geometry=end_2.Start, Motion=vec_2.Vector)  # -> graft(Geometry), Transform
move_4 = Move(Geometry=end_2.End, Motion=vec_2.Vector)  # -> graft(Geometry), Transform

nurbs = NurbsCurve(Vertices=[pt_2, move_3.Geometry, move_4.Geometry, pt_3], Degree=3, Periodic=False)  # -> Curve, Length, Domain
pline = PolyLine(Vertices=[pt_2, move_3.Geometry, move_4.Geometry, pt_3], Closed=False)
reb = RebuildCurve(Curve=nurbs.Curve, Degree=1, Count=Slider(4, range=0..10), Tangents=False)
explode = Explode(Curve=reb, Recursive=True)  # -> flatten(Segments), Vertices
dupln = RemoveDuplicateLines(Lines=explode.Segments, Tolerance=0.01)  # -> flatten(UniqueLines)

divide = DivideCurve(Curve=nurbs.Curve, Count=Slider(2, range=0..10), Kinks=False)  # -> ReachingPoints, Tangents, Parameters
item_2 = ListItem(List=divide.ReachingPoints, Index=Slider(1, range=0..100), Wrap=True)  # -> flatten(Item)
Q = ClusterOutput(dupln)
i = ClusterOutput(item_2)

# ==== cluster MidLevelCurveGenerationSystem
number = ClusterInput()
X = ClusterInput()
number_2 = ClusterInput()
num = ClusterInput()
X_2 = ClusterInput()
Y = ClusterInput()
z_component = ClusterInput()
number_3 = Number(number)
number_4 = Number(number_2)
G = ClusterInput()

rectangle = Rectangle(Plane=PlaneXY(0, 0, 0), XSize=X, YSize=X, Radius=0)  # -> Rectangle, Length
arrrec = RectangularArray(Geometry=G, Cell=rectangle.Rectangle, XCount=number_3, YCount=number_4)  # -> Geometry, Transform
num_2 = Number(num)
vec = VectorXYZ(XComponent=X_2, YComponent=Y, ZComponent=0)  # -> Vector, Length
vector_xyz = VectorXYZ(XComponent=0, YComponent=0, ZComponent=z_component)  # -> Vector, Length
list_item = ListItem(List=arrrec.Geometry, Index=graft(num_2), Wrap=False)
index = ItemIndex(List=arrrec.Geometry, Item=arrrec.Geometry)

G_2 = ClusterOutput(arrrec.Geometry)
index_2 = ItemIndex(List=arrrec.Geometry, Item=arrrec.Geometry)
i = ClusterOutput(index)
clean = CleanTree(RemoveNulls=True, RemoveInvalid=True, RemoveEmpty=True, Tree=list_item)
tag = TextTag3D(
    Location=arrrec.Geometry,
    Text=index_2,
    Size=Slider(4, range=0..10),
    Colour=ColourSwatch(SwatchColor=RGB(0, 0, 0)),
    Justification=7)

move = Move(Geometry=clean, Motion=vector_xyz.Vector)  # -> Geometry, Transform
line = Line(StartPoint=move.Geometry, EndPoint=clean)  # -> flatten(Line)
move_2 = Move(Geometry=line, Motion=vec.Vector)  # -> Geometry, Transform
end_points = EndPoints(Curve=move_2.Geometry)  # -> Start, End

G_3 = ClusterOutput(move_2.Geometry)
start = ClusterOutput(end_points.Start)
end = ClusterOutput(end_points.End)

# ==== cluster BottomLevelCurveGenerationSystem
X = ClusterInput()
z_component = ClusterInput()
G = ClusterInput()
X_2 = ClusterInput()
Y = ClusterInput()
X_3 = ClusterInput()
Y_2 = ClusterInput()
num = ClusterInput()

vec = VectorXYZ(XComponent=X_3, YComponent=Y_2, ZComponent=0)  # -> Vector, Length
num_2 = Number(num)
rectangle = Rectangle(Plane=PlaneXY(0, 0, 0), XSize=X, YSize=X, Radius=0)  # -> Rectangle, Length
vector_xyz = VectorXYZ(XComponent=0, YComponent=0, ZComponent=z_component)  # -> Vector, Length
arrrec = RectangularArray(Geometry=G, Cell=rectangle.Rectangle, XCount=X_2, YCount=Y)  # -> Geometry, Transform
list_item = ListItem(List=arrrec.Geometry, Index=graft(num_2), Wrap=False)

index = ItemIndex(List=arrrec.Geometry, Item=arrrec.Geometry)
clean_tree = CleanTree(Tree=list_item, CleanInvalid=True, CleanEmpty=True)
G_2 = ClusterOutput(arrrec.Geometry)

index_2 = ItemIndex(List=arrrec.Geometry, Item=arrrec.Geometry)

move = Move(Geometry=clean_tree, Motion=vector_xyz.Vector)  # -> Geometry, Transform
line = Line(StartPoint=move.Geometry, EndPoint=clean_tree)  # -> flatten(Line)
move_2 = Move(Geometry=line, Motion=vec.Vector)  # -> Geometry, Transform
end_points = EndPoints(Curve=move_2.Geometry)  # -> Start, End

i = ClusterOutput(index_2)
tag = TextTag3D(
    Location=arrrec.Geometry,
    Text=index,
    Size=Slider(4, range=0..10),
    Colour=ColourSwatch(SwatchColor=RGB(0, 0, 0)),
    Justification=7)
G_3 = ClusterOutput(move_2.Geometry)
start = ClusterOutput(end_points.Start)
end = ClusterOutput(end_points.End)

# ==== cluster Cluster
points = ClusterInput()
proximity_3d = Proximity3D(Points=points, Group=5)  # -> Links, Topology
divide_curve = DivideCurve(Curve=proximity_3d.Links, Count=Slider(2, range=0..10), Kinks=False)  # -> Points, Tangents, Parameters
list_item = ListItem(List=divide_curve.Points, Index=1, Wrap=True)  # -> flatten(Item)
cull_duplicates = CullDuplicates(Points=list_item, Tolerance=0.1, CullMode=3)  # -> Points, Indices, Valence
points_2 = ClusterOutput(cull_duplicates.Points)
