# Grasshopper definition hysteresis2.0.ghx (Grasshopper 0.9.76)
# plug-ins: Python Interpreter, Human UI, Flux

index = ControlKnob(Decimals=0, Limit=False, Maximum=10, Minimum=0, Range=10, Value=15)
record = Button()
reset = Button()

new_product = Button()
send_to_gallery = BooleanToggle(False)

which_product = ValueList({"Recorded": "recorded", "Gallery": "gallery"}, selected="Gallery")

param01_1stlevelheight = Slider(90, range=50..200)
m_p3_index = Slider(-1, range=-1..24)
b_p2_index = Slider(0, range=-1..24)
b_p3_index = Slider(6, range=-1..24)
b_p4_index = Slider(16, range=-1..24)
param03_linemergingtreshold = Slider(15, range=10..18)
param01_2ndlevelheight = Slider(90, range=50..200)
param02_gridcount = Slider(5, range=0..10)
t_p1_index = Slider(1, range=-1..15)
t_p2_index = Slider(3, range=-1..24)
t_p3_index = Slider(6, range=-1..24)
t_p4_index = Slider(12, range=-1..24)
m_p1_index = Slider(1, range=-1..24)
m_p2_index = Slider(8, range=-1..24)
m_p4_index = Slider(22, range=-1..24)
b_p1_index = Slider(5, range=-1..24)
param04_displacementrange = Slider(0, range=0..10)
t_p5_index = Slider(4, range=-1..24)
m_p5_index = Slider(23, range=-1..24)
b_p5_index = Slider(2, range=-1..24)
doguscan_3l = Doguscan_3L(
    num_18=param01_1stlevelheight,
    num_19=param01_2ndlevelheight,
    num_20=param02_gridcount,
    num=t_p1_index,
    num_3=t_p2_index,
    num_5=t_p3_index,
    num_7=t_p4_index,
    num_9=t_p5_index,
    num_2=m_p1_index,
    num_4=m_p2_index,
    num_6=m_p3_index,
    num_8=m_p4_index,
    num_12=m_p5_index,
    num_10=b_p1_index,
    num_13=b_p2_index,
    num_14=b_p3_index,
    num_16=b_p4_index,
    num_17=b_p5_index,
    num_11=param03_linemergingtreshold,
    num_15=param04_displacementrange)  # -> data_2, geo_2
flux = FluxProject(project="a9jAyvE70YL3qR5WZ")  # -> Keys, Meta
flow_control = FlowControl({"Once", "Constantly"}, selected="Constantly")
to_flux = ToFlux(Keys=flux.Keys, Mode=flow_control, keyId="40e273591a581a702b10445b1567f97b", mode="Constantly")
to_flux_2 = ToFlux(Keys=flux.Keys, Mode=flow_control, keyId="40eb4de7d220ebd98aef0ffb841f45d5", mode="Constantly")
createsnippet = CreateSnippet(run=Button(ExpressionNormal="True", ExpressionPressed="False"))  # -> out, A; inputs run: Boolean
# ---------- createsnippet: C# ----------
    if(!run) return;
    GH_DocumentIO docIO = new GH_DocumentIO(GrasshopperDocument);
    List<Guid> objectsToCopy = new List<Guid>();
    foreach(IGH_DocumentObject obj in GrasshopperDocument.Objects){ //for all objs in GH doc
      if(obj is Grasshopper.Kernel.Special.GH_Group){ //if it's a group
        Grasshopper.Kernel.Special.GH_Group grp = obj as Grasshopper.Kernel.Special.GH_Group;
        if(grp.Objects().Exists(x => x.InstanceGuid == this.Component.InstanceGuid)){ //if the group contains this script
          foreach(IGH_DocumentObject grpObj in grp.Objects()){ // for all the objects in the group
            if(grpObj.InstanceGuid != this.Component.InstanceGuid){ // if the object isn't this component
              //save the guid of the objects to copy
              objectsToCopy.Add(grpObj.InstanceGuid);
            }
          }
        }

      }
    }

    //create a binary representation of the objects from the group by copying them and serializing the XML from the clipboard
    docIO.Copy(GH_ClipboardType.System, objectsToCopy);
    string snippet = System.Windows.Forms.Clipboard.GetText();
    docIO.ClearClipboard(GH_ClipboardType.System);

    string locked = "<item name=\"Locked\" type_name=\"gh_bool\" type_code=\"1\">true</item>";
    string unlocked = "<item name=\"Locked\" type_name=\"gh_bool\" type_code=\"1\">false</item>";
    // string locked = @"" < item name = "Locked" type_name = "gh_bool" type_code = "1" > true</item > "";
    // string unlocked = @"" < item name = "Locked" type_name = "gh_bool" type_code = "1" > false</item > "";

    snippet = snippet.Replace(locked, unlocked);
    A = snippet;
# ---------- end createsnippet ----------

geo = Geometry(doguscan_3l.geo_2)

flow_control_2 = FlowControl({"Once", "Constantly"}, selected="Constantly")
flux_2 = FluxProject(project="a9jAyvE70YL3qR5WZ")  # -> Keys, Meta
to_flux_3 = ToFlux(
    Keys=flux_2.Keys,
    Value=createsnippet.A,
    Mode=flow_control_2,
    keyId="40125174d928b38689aec28fc8e6e8ed",
    mode="Constantly")
from_flux = FromFlux(
    Keys=flux_2.Keys,
    Mode=flow_control_2,
    keyId="40eb4de7d220ebd98aef0ffb841f45d5",
    mode="Constantly",
    Branch0_Path="{0;0;0;0}",
    Branch0_Item0_TypeName="Grasshopper.Kernel.Types.GH_Mesh")  # -> Value, Meta
move = Move(Geometry=from_flux.Value, Motion=Vector(276, 0, 0))  # -> Geometry, Transform

number_slider = Slider(652, range=500..1000)
number_slider_2 = Slider(776, range=500..1000)

getguid = PythonScript(comp=move.Geometry)  # -> out, out_guid
# ---------- getguid: Python ----------
for input in ghenv.Component.Params.Input:
    for source in input.Sources:
        if str(source.Type) == "Grasshopper.Kernel.Types.IGH_GeometricGoo":
            out_guid = str(source.InstanceGuid)
# ---------- end getguid ----------
item = CherryPicker(getguid.out_guid, ListIndex=0)
panel = Panel(item)

gridtype = Slider(4, range=0..4)
outputshape_seg = Slider(3, range=3..8)
outputshape = Slider(0, range=0..1)
pointy = Slider(0.6, range=0..1)
attf_x = Slider(0, range=0..2)
scale = Slider(1, range=1..15)
pointx = Slider(0.8, range=0..1)
angle = Slider(0, range=0..100)
reactorgen = ReactorGen(G=gridtype, G_2=attf_x, G_3=outputshape, S=outputshape_seg, A=pointx, A_2=pointy, B=scale, A_3=angle)  # disabled
geo_2 = Geometry(reactorgen)

window = LaunchWindow(Show=Toggle(True), Name="Compare", Width=370, Height=400, ChildStatus=1)
text = CreateTextBox(Label="Cartesian Product from", DefaultText=which_product, UpdateButton=True)

getdirectory = PythonScript()  # -> dir, file_name, full_path
# ---------- getdirectory: Python ----------
import os
fn = ghenv.Component.OnPingDocument()
file_name = (str(fn)).strip("*")
print file_name

full_path = (ghenv.Component.OnPingDocument().FilePath)

dir = full_path.replace(file_name+".ghx","")
print dir
print full_path
# ---------- end getdirectory ----------
c_script = CSharpScript(Cluster="Doguscan_3L", Output="Output")  # -> out, Data; inputs Cluster: String, Output: String
# ---------- c_script: C# ----------
    RegisterSolutionStartEvent();

    IGH_Param parameter = FindParameter(Cluster, Output);
    if (parameter == null)
    {
      Print("No such cluster+parameter could be found");
      return;
    }

    Data = HarvestData(parameter);
# ---------- c_script: C# additional code ----------
  private bool _registered = false;

  private void RegisterSolutionStartEvent()
  {
    if (_registered)
      return;

    _registered = true;
    GrasshopperDocument.SolutionStart += Document_SolutionStart;
  }

  private void Document_SolutionStart(object sender, EventArgs e)
  {
    // TODO: figure out whether the cluster we're supposed to be watching
    //       has expired. If so, then we need to expire this component as well.
    
    Component.ExpireSolution(false);
  }
  private IGH_Param FindParameter(string clusterName, string outputName)
  {
    // Iterate over all objects in the document.
    foreach (IGH_DocumentObject obj in GrasshopperDocument.Objects)
    {
      // Make sure nickname matches.
      if (!string.Equals(clusterName, obj.NickName, StringComparison.Ordinal))
        continue;

      // Make sure object is a cluster.
      Grasshopper.Kernel.Special.GH_Cluster cluster = obj as Grasshopper.Kernel.Special.GH_Cluster;
      if (obj == null)
        continue;

      // Iterate over all output parameters.
      foreach (IGH_Param output in cluster.Params.Output)
        if (string.Equals(output.NickName, outputName, StringComparison.Ordinal))
          return output;
    }

    return null;
  }
  private DataTree<object> HarvestData(IGH_Param parameter)
  {
    // Make sure the cluster has been solved.
    Grasshopper.Kernel.Special.GH_Cluster cluster =
      parameter.Attributes.Parent.DocObject as Grasshopper.Kernel.Special.GH_Cluster;
    if (cluster == null)
      return null;

    if (cluster.Phase != GH_SolutionPhase.Computed)
    {
      cluster.CollectData();
      cluster.ComputeData();
    }

    IGH_Structure tree = parameter.VolatileData;
    if (tree == null)
    {
      Print("Parameter contains no data.");
      return null;
    }

    DataTree<object> newTree = new DataTree<object>();
    newTree.MergeStructure(tree, null);
    return newTree;
  }
# ---------- end c_script ----------
datafile = PythonScript(path=getdirectory.dir)  # -> datafile
# ---------- datafile: Python ----------
import os
datafile = os.path.join(path, "data.dat")
print datafile
# ---------- end datafile ----------
restorefile = PythonScript(path=getdirectory.dir)  # -> restorefile
# ---------- restorefile: Python ----------
import os

pardir = os.path.abspath(os.path.join(path, os.pardir))

restorefile = os.path.join(pardir, "received"+os.path.sep+"restore.json")
print path
print pardir
print restorefile
# ---------- end restorefile ----------
file = ReadFile(File=restorefile, PerLineParse=False)
file_2 = ReadFile(F=datafile, PerLineParse=True)  # -> C
#   port F: Uri of file to read
# ---------- file_2: VB line parser ----------
    action = GH_LineParserAction.Include
    Return line

    'Parse the line and return some data that represents the line.
    'If the line cannot be parsed, you can return Nothing and
    'assign a different action.
    'The default implementation is to just return the line itself.
    'If you return types that implement IGH_Goo, this component
    'will work substantially faster.
# ---------- end file_2 ----------
restore_state = PythonScript(file=file, node_name="Doguscan_3L")
# ---------- restore_state: Python ----------
import json
state = json.loads(file)
print state

ghObjects = ghenv.Component.OnPingDocument().Objects
for obj in ghObjects:
    if obj.NickName == node_name:
        for input in obj.Params.Input:
            value = state['params'][input.NickName]
            input.Sources[0].Slider.Value = value
        obj.ExpireSolution(True)
# ---------- end restore_state ----------
magicbox = PythonScript(node_name="Doguscan_3L", data=simplify(file_2), index=index)  # -> matrix, keys, index, a; inputs data: list
# ---------- magicbox: Python ----------
import json
import cPickle
import itertools
import Grasshopper as gh
from System import Guid
from scriptcontext import doc
import os
import time

keylist = []
valuelist = []

#def chunks(l, n):
#    """Yield successive n-sized chunks from l."""
#    for i in xrange(0, len(l), n):
#        yield l[i:i+n]
#        
#def get_node(name):
#    ghObjects = ghenv.Component.OnPingDocument().Objects
#    for obj in ghObjects:
#        if obj.NickName == name:
#            return obj
#    print "Node not found"
def create_flipdict(data):
    veclist = []
    # turn strings into dicts
    for item in data:
        alt = json.loads(item)
        veclist.append(alt["params"])
    flipdict = dict()    
    # get the names of keys to iterate over 
    for vec in veclist:   
        for key in vec:
            flipdict[key] = []
    
    #accumulate
    for key in flipdict:
        for vec in veclist:
            if key in vec:
                flipdict[key].append(vec[key])
    return flipdict                

def create_matrix(flipdict):
        
    #create matrix 
    matrix = []       
    for key in flipdict:
        matrix.append(list(set(flipdict[key])))
        keylist.append(key)
    return matrix

#def generate_cproduct(matrix):
#    #cartesian product
#    product = []
#    for item in itertools.product(*matrix):
#        product.append(item)
#    return product
#
#def get_alt(index, productlist,flipdict):
#    i = int(index)%(len(productlist)) 
#    selection = productlist[i]    
#    rvec = dict()    
#    nkeylist = []
#    for key in flipdict:
#        nkeylist.append(key)
#    for key,value in zip(nkeylist,selection):
#        rvec[key] = value
#    return rvec
#
#def update_model(rvec, node):
#    for input in node.Params.Input:
#        value = rvec[input.NickName]
#        input.Sources[0].Slider.Value = value
#    node.ExpireSolution(True)
#    print "Updated "+node.NickName


# Generate cartesian product from Rhino/GH input 
# and send to gallery on click
#node = get_node(node_name)
flipdict = create_flipdict(data)
matrix = create_matrix(flipdict)
#cproduct = generate_cproduct(matrix)
#_alt = get_alt(index, cproduct, flipdict)
#repeater = get_node("2"+node_name)
#update_model(_alt,repeater)
#alt=json.dumps(_alt)
#_matrix = json.dumps(matrix)
_matrix = matrix
keys = keylist
a = json.dumps(flipdict)
print a
#cPickle.dumps(keylist)
# ---------- end magicbox ----------
data_grabber = PythonScript(node_name="Doguscan_3L", path=datafile, output_data=c_script.Data, record=record, reset=reset)  # inputs output_data: list, record: Boolean
# ---------- data_grabber: Python ----------
import Grasshopper as gh
import os
import json
#path1 = os.path.dirname(path)
#print path1
#path.replace("public\","data.dat")
print path
ghObjects = ghenv.Component.OnPingDocument().Objects
d = dict()
d["Output"] = {}
d["params"] = {}
key_list = []
if record:
    for obj in ghObjects:
        if obj.NickName == node_name.ToString():
            value_list = []
            for input in obj.Params.Input:
                if input.Sources[0].NickName:
                    key = input.Sources[0].NickName
                else:
                    input.Sources[0].NickName = input.NickName
                    key = input.Sources[0].NickName
                value = input.Sources[0].Slider.Value.ToDouble(input.Sources[0].Slider.Value)
                d["params"][key] = value
                value_list.append(value)
    for i in range(0,len(output_data),2):
        d["Output"][str(output_data[i])]= output_data[i+1]
    if len(d)>0:
#        d_vector = value_list
        print d
        if os.path.exists(path):
            with open(path, 'a') as outfile:
                json.dump(d, outfile)            
            f = open(path,'a')
            f.write('\n')
            print d
        else:
            with open(path, 'w') as outfile:
                json.dump(d, outfile)
            f = open(path,'a')
            f.write('\n')
        f.close()
 
if reset:
    f = open(path,'w')
    f.write('')
    f.close()
        
#for obj in ghObjects:
#    if obj.NickName == node_name.ToString():
#        value_list = []
#        for input in obj.Params.Input:
#            key_list.append(input.NickName)
#
#length = int(len(key_list))
# ---------- end data_grabber ----------
flow_control_3 = FlowControl({"Once", "Constantly"}, selected="Constantly")
flux_3 = FluxProject(project="a9jAyvE70YL3qR5WZ")  # -> Keys, Meta
serialize = PythonScript(input=magicbox.keys)  # -> output
# ---------- serialize: Python ----------
import cPickle
output = cPickle.dumps(input)
print output
print(type(output))
# ---------- end serialize ----------
serialize_2 = PythonScript(input=magicbox.matrix)  # -> output; same code as serialize
serialize_3 = PythonScript(input="Doguscan_3L")  # -> output; same code as serialize
from_flux_2 = FromFlux(
    Keys=flux_3.Keys,
    Mode=flow_control_3,
    keyId="408642bb36ad94d34f040012d21f4c92",
    mode="Constantly",
    Branch0_Path="{0;0;0;0}",
    Branch0_Item0_null_string=False,
    Branch0_Item0_string="""(dp0
VB_P1_Index
p1
F5.0
sVparam01_2NDLevelHeight
p2
F90.0
sVM_P3_Index
p3
F-1.0
sVParam04_DisplacementRange
p4
F0.0
sVparam01_1STLevelHeight
p5
F90.0
sVT_P5_Index
p6
F4.0
sVM_P2_Index
p7
F8.0
sVB_P5_Index
p8
F2.0
sVT_P4_Index
p9
F12.0
sVM_P1_Index
p10
F1.0
sVB_P4_Index
p11
F16.0
sVparam02_GridCount
p12
F5.0
sVT_P3_Index
p13
F6.0
sVB_P3_Index
p14
F6.0
sVT_P2_Index
p15
F3.0
sVM_P5_Index
p16
F23.0
sVB_P2_Index
p17
F0.0
sVT_P1_Index
p18
F1.0
sVParam03_LineMergingTreshold
p19
F15.0
sVM_P4_Index
p20
F22.0
s.""",
    Branch0_Item0_TypeName="Grasshopper.Kernel.Types.GH_String")  # -> Value, Meta
kernel2product = PythonScript(
    node_name="Doguscan_3L",
    dir=getdirectory.dir,
    full_path=getdirectory.full_path,
    trigger=new_product,
    currentModel=magicbox.a)  # -> a
# ---------- kernel2product: Python ----------
import json
import itertools
import Grasshopper as gh
from System import Guid
from scriptcontext import doc
import os
import time
import Rhino
import rhinoscriptsyntax as rs
import cPickle

gh = Rhino.RhinoApp.GetPlugInObject("Grasshopper")

rs.EnableRedraw(True)

pardir = os.path.abspath(os.path.join(dir, os.pardir))
path = os.path.join(pardir,"gallery"+os.sep)
print path
pardir2 = os.path.abspath(os.path.join(path, os.pardir))
path_kernel = os.path.join(pardir2, "received"+os.path.sep)
print path_kernel
keylist = []
valuelist = []
RhinoDocument = Rhino.RhinoDoc.ActiveDoc
view = RhinoDocument.Views.Find('kernel', False)
print view


#
#def chunks(l, n):
#    """Yield successive n-sized chunks from l."""
#    for i in xrange(0, len(l), n):
#        yield l[i:i+n]
#
def create_flipdict(data):
    veclist = []
    # turn strings into dicts
    for item in data:
        vec = eval(item)
        veclist.append(vec)
    
    flipdict = dict()    
    # get the names of keys to iterate over 
    for vec in veclist:   
        for key in vec:
            flipdict[key] = []
    
    #accumulate
    for key in flipdict:
        for vec in veclist:
            if key in vec:
                flipdict[key].append(vec[key])
    return flipdict                

def create_matrix(flipdict):
        
    #create matrix 
    matrix = []       
    for key in flipdict:
        matrix.append(set(flipdict[key]))
    return matrix

def generate_cproduct(matrix):
    #cartesian product
    product = []
    for item in itertools.product(*matrix):
        product.append(item)
    return product

def get_alt(index, productlist,flipdict):
    i = int(index)%(len(productlist)) 
    selection = productlist[i]    
    rvec = dict()    
    nkeylist = []
    for key in flipdict:
        nkeylist.append(key)
    for key,value in zip(nkeylist,selection):
        rvec[key] = value
    return rvec

def update_model(rvec, node):
    for input in node.Params.Input:
        value = rvec[input.NickName]
        input.Sources[0].Slider.Value = value
    node.ExpireSolution(False)
    print "Updated "+node.NickName
    
def get_node(name):
    ghObjects = ghenv.Component.OnPingDocument().Objects
    for obj in ghObjects:
        if obj.NickName == name:
            return obj
    print "Node not found"
def captureView(uid):
    bmp = view.CaptureToBitmap(False, False, False)
    bmp.Save(path+uid+".bmp")       

def send_to_gallery(data,send):
    if send:
        json_data = dict()
    
        uid = str(Guid.NewGuid())
        json_data['params'] = data
        json_data['uid'] = uid
        json_data['cad_file'] = 'xyz.obj'
        json_data['image'] = uid+'.bmp'
        captureView(uid)
#        bitmap = doc.Views.ActiveView.CaptureToBitmap(True, True, True)
#        bitmap.Save(path+uid+'.bmp')
        with open(path+uid+'.json','w') as outfile:
            json.dump(json_data, outfile, indent=2)
        print "Sent "+uid+" to gallery"  
        baked = gh.BakeDataInObject(comp_guid)





# Generate cart. prod. from new kernel and slowly send to gallery
node = get_node(node_name)
# Read file
if os.path.exists(path_kernel+'kernel.json'):
    f = open(path_kernel+'kernel.json','r')
    data = f.read()
    f.close()
    if len(data)>0:
# Fill in missing params
        _currModel = json.loads(currentModel)
        _data = json.loads(data)
        
        for key in _currModel:
            if len(_data[key])<1:
                _data[key]+=_currModel[key]
        a = json.dumps(_data)
        
        print data, "\n"
        print _currModel, "\n"
        print a

# IGNORE THIS SHIT        
        # parse the data into dict
#        kernel = eval(data)
#       erase the file contents to prevent infinite loop
#       f = open(path_kernel+'kernel.json','w')
#       f.write('')
#       f.close()
            
#        _matrix = create_matrix(kernel)
#        a = _matrix
#            _cproduct = generate_cproduct(_matrix)
#            
#            #now iterate over _cproduct and update model
#            #then wait for 1 sec and take snapshot, send to gall
#            for i in range(0,3,1):
#                _alt = get_alt(i , _cproduct, kernel)
#                update_model(_alt,node)
#                time.sleep(1)
#                gh.RunSolver(full_path)
#                time.sleep(1)
#                send_to_gallery(_alt, True)
# ---------- end kernel2product ----------
serialize_4 = PythonScript(input=kernel2product)  # -> output; same code as serialize
to_flux_4 = ToFlux(Keys=flux_3.Keys, Value=serialize_3, Mode=flow_control_3, keyId="4082566f6a4c3b9b7b26701fdb4b1c3b", mode="Constantly")
to_flux_5 = ToFlux(Keys=flux_3.Keys, Value=serialize_2, Mode=flow_control_3, keyId="404722a83a22684e0079a179785efa64", mode="Constantly")
to_flux_6 = ToFlux(Keys=flux_3.Keys, Value=serialize, Mode=flow_control_3, keyId="40fc6dc0a9c8f0442f6624b91b6640f1", mode="Constantly")
to_flux_7 = ToFlux(Keys=flux_3.Keys, Value=magicbox.index, Mode=flow_control_3, keyId="40b8bce9d56129e52fe444d295fc9af4", mode="Constantly")

flow_control_4 = FlowControl({"Once", "Constantly"}, selected="Constantly")
deserialize2list = PythonScript(input=from_flux_2.Value)  # -> keyList, valueList, output
# ---------- deserialize2list: Python ----------
import cPickle
dict = cPickle.loads(input)
keyList = []
valueList = []
for key in dict:
    keyList.append(key)
    valueList.append(dict[key])
#output = "Parameter values :\n" + str(cPickle.loads(input))
print output
print(type(output))
print keyList, valueList
# ---------- end deserialize2list ----------
to_flux_8 = ToFlux(Keys=flux_3.Keys, Value=which_product, Mode=flow_control_3, keyId="4006faa082ee097903a6e99e6db4516a", mode="Constantly")
from_flux_3 = FromFlux(
    Keys=flux_3.Keys,
    Mode=flow_control_3,
    keyId="40e273591a581a702b10445b1567f97b",
    mode="Constantly",
    Branch0_Path="{0}",
    Branch0_Item0_null_string=False,
    Branch0_Item0_string="NumberOfNetworkCurves",
    Branch0_Item0_TypeName="Grasshopper.Kernel.Types.GH_String",
    Branch0_Item1_number=87,
    Branch0_Item1_TypeName="Grasshopper.Kernel.Types.GH_Integer",
    Branch0_Item2_null_string=False,
    Branch0_Item2_string="BLevel_Indices",
    Branch0_Item2_TypeName="Grasshopper.Kernel.Types.GH_String",
    Branch0_Item3_number=5,
    Branch0_Item3_TypeName="Grasshopper.Kernel.Types.GH_Integer",
    Branch0_Item4_number=0,
    Branch0_Item4_TypeName="Grasshopper.Kernel.Types.GH_Integer",
    Branch0_Item5_number=6,
    Branch0_Item5_TypeName="Grasshopper.Kernel.Types.GH_Integer",
    Branch0_Item6_number=16,
    Branch0_Item6_TypeName="Grasshopper.Kernel.Types.GH_Integer",
    Branch0_Item7_number=2,
    Branch0_Item7_TypeName="Grasshopper.Kernel.Types.GH_Integer",
    Branch0_Item8_null_string=False,
    Branch0_Item8_string="MLevel_Indices",
    Branch0_Item8_TypeName="Grasshopper.Kernel.Types.GH_String",
    Branch0_Item9_number=1,
    Branch0_Item9_TypeName="Grasshopper.Kernel.Types.GH_Integer",
    Branch0_Item10_number=8,
    Branch0_Item10_TypeName="Grasshopper.Kernel.Types.GH_Integer",
    Branch0_Item11_number=-1,
    Branch0_Item11_TypeName="Grasshopper.Kernel.Types.GH_Integer"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)  # -> Value, Meta

python = PythonScript(in_data=from_flux_3.Value)  # -> name, value; inputs in_data: tree
# ---------- python: Python ----------
name = []
value = []
l = in_data.Branch(0)

for i in range(0,len(l),2):
    name.append(l[i])
    value.append(l[i+1])
# ---------- end python ----------

multichart = CreateMultiChart(
    Data=deserialize2list.valueList,
    Names=deserialize2list.keyList,
    Title="Input params",
    ClusterTitle="Input param values of selected result",
    ChartType=0)
multichart_2 = CreateMultiChart(Data=python.value, Names=python.name, Title="Outputs", ClusterTitle="Input param values of selected result", ChartType=0)

addelems = AddElements(Window=window, Elements=flatten([multichart, multichart_2, text]))  # -> AddedElements, ElementNames
adjustpos = AdjustElementPositioning(ElementsToAdjust=multichart, AbsolutePositioning=False, Width=number_slider_2, Height=number_slider_2)
adjustpos_2 = AdjustElementPositioning(ElementsToAdjust=multichart_2, AbsolutePositioning=False, Width=number_slider, Height=number_slider)

send_to_gallery_2 = PythonScript(
    alt=from_flux_2.Value,
    dir=getdirectory.dir,
    cad_file=getdirectory.full_path,
    send=send_to_gallery,
    comp_guid=panel,
    output_data=from_flux_3.Value,
    node_name="Doguscan_3L")  # inputs output_data: list
# ---------- send_to_gallery_2: Python ----------
##OBJ SETTINGS##
e_str = "_Geometry=_Mesh "
e_str+= "_EndOfLine=CRLF "
#e_str+= "_ExportRhinoObjectNames=_ExportObjectsAsOBJGroups "
e_str+= "_ExportMeshTextureCoordinates=_Yes "
e_str+= "_ExportMeshVertexNormals=_Yes "
e_str+= "_CreateNGons=_No "
e_str+= "_ExportMaterialDefinitions=_No "
e_str+= "_YUp=_Yes "
e_str+= "_WrapLongLines=Yes "
e_str+= "_VertexWelding=_Welded "
e_str+= "_WritePrecision=4 "
e_str+= "_Enter "
#e_str+= "_DetailedOptions "
#e_str+= "_JaggedSeams=_No "
#e_str+= "_PackTextures=_No "
#e_str+= "_Refine=_Yes "
#e_str+= "_SimplePlane=_No "
#e_str+= "_AdvancedOptions "
#e_str+= "_Angle=50 "
#e_str+= "_AspectRatio=0 "
#e_str+= "_Distance=0.0"
#e_str+= "_Density=0 "
#e_str+= "_Density=0.45 "
#e_str+= "_Grid=0 "
#e_str+= "_MaxEdgeLength=0 "
#e_str+= "_MinEdgeLength=0.0001 "
e_str+= "_Enter _Enter"
## OBJ SETTING


from System import Guid
import cPickle
import json
from scriptcontext import doc
import rhinoscriptsyntax as rs
import os
import System.Drawing
import Rhino
pardir = os.path.abspath(os.path.join(dir, os.pardir))
path = os.path.join(pardir,"gallery"+os.sep)
print path
print output_data
alt = cPickle.loads(alt)
normalized_path = os.path.abspath(cad_file).ToString()
print normalized_path
#_alt = json.loads(alt)
RhinoDocument = Rhino.RhinoDoc.ActiveDoc
view = RhinoDocument.Views.Find('product', False)
print view
print comp_guid
gh = Rhino.RhinoApp.GetPlugInObject("Grasshopper")


def captureView(uid):
    bmp = view.CaptureToBitmap(False, False, False)
    bmp.Save(path+uid+".bmp")

#def rCommonCap(viewportName,scaleFactor):
#    RhinoDocument = Rhino.RhinoDoc.ActiveDoc
#    view = RhinoDocument.Views.Find('product', False)
##    vp = view.ActiveViewport
##    size = System.Drawing.Size(vp.Size.Width*scaleFactor,vp.Size.Height*scaleFactor)
#    capture = view.CaptureToBitmap(True, True, True)
#    return capture

def send_to_gallery(data):
    uid = str(Guid.NewGuid())
    captureView(uid)
    
    baked = gh.BakeDataInObject(comp_guid)

    cad_file_name = uid + ".stl"
    rs.Command("_SelNone", True)
    rs.Command("_SelLast", True)
    command = '-_Export "{}{}{}" {}'.format(path, uid, "."+"obj", e_str)
    rs.Command(command, True)
    rs.Command("_SelLast", True)
    rs.Command("_Delete", True)
    rs.Command("_SelNone", True)    
    
    json_data = dict()
    json_data["filepath"] = normalized_path
    json_data["params"] = data
    json_data["uid"] = uid
    json_data["cad_file"] = uid+'.obj'
    json_data["image"] = uid+'.bmp'   
    json_data["Output"] = {}
    json_data["model_name"] = node_name
    for i in range(0,len(output_data),2):
        json_data["Output"][output_data[i]] = output_data[i+1]
    print json_data
    with open(path+uid+'.json','w') as outfile:
        json.dump(json_data, outfile, indent=2)
    

    print "Sent "+uid+" to gallery"
print alt    
if send:
    send = False
    send_to_gallery(alt)
# ---------- end send_to_gallery_2 ----------
to_flux_9 = ToFlux(Keys=flux_3.Keys, Value=serialize_4, Mode=flow_control_4, keyId="403b08d4ea68137ba11c4286c4962062", mode="Constantly")

# ==== cluster ReactorGen
A = ClusterInput()
A_2 = ClusterInput()
sqgrid = Square(Plane=PlaneXY(0, 0, 0), Size=10, ExtentX=10, ExtentY=10)  # -> Cells, Points
trigrid = Triangular(Plane=PlaneXY(0, 0, 0), Size=10, ExtentX=20, ExtentY=12)  # -> Cells, Points
hexgrid = Hexagonal(Plane=PlaneXY(0, 0, 0), Size=8, ExtentX=10, ExtentY=8)  # -> Cells, Points
radgrid = Radial(Plane=PlaneXY(50, 50, 0), Size=5, ExtentR=10, ExtentP=20)  # -> Cells, Points
pop2d = Populate2D(Region={Plane=PlaneXY(0, 0, 0), Size=Domain2(u=0..100, v=0..100)}, Count=100, Seed=1)
G = ClusterInput()
scaleup = Multiplication(A=A, B=100)
scaleup_2 = Multiplication(A=A_2, B=100)
pt = ConstructPoint(XCoordinate=scaleup, YCoordinate=scaleup_2, ZCoordinate=0)
gridtype = StreamFilter(Gate=G, Stream0=pop2d, Stream1=radgrid.Points, Stream2=trigrid.Points, Stream3=hexgrid.Points, Stream4=sqgrid.Points)
pt_2 = Point(pt)
G_2 = ClusterInput()
linept_grid = Line(StartPoint=gridtype, EndPoint=pt_2)
f_x_chooser = StreamFilter(Gate=G_2, Stream0="x/2", Stream1="x", Stream2="x*sin(x)")
len = Length(Curve=linept_grid)
B = ClusterInput()
eval = Evaluate(F=f_x_chooser, x=len)
scaledown = Division(A=eval, B=B)
A_3 = ClusterInput()
G_3 = ClusterInput()
outputtype = StreamGate(Stream=gridtype, Gate=G_3)  # -> Target0, Target1
S = ClusterInput()
circle = CircleCNR(Center=outputtype.Target0, Normal=Vector(0, 0, 1), Radius=scaledown)
polygon = Polygon(Plane=outputtype.Target1, Radius=scaledown, Segments=S, FilletRadius=0)  # -> Polygon, Length
rotate = Rotate(Geometry=polygon.Polygon, Angle=A_3, Plane=outputtype.Target1)  # -> Geometry, Transform
merge = Merge(Data1=circle, Data2=rotate.Geometry)
R = ClusterOutput(merge)

# ==== cluster Doguscan_3L
num = ClusterInput()
num_2 = ClusterInput()
num_3 = ClusterInput()
num_4 = ClusterInput()
num_5 = ClusterInput()
num_6 = ClusterInput()
num_7 = ClusterInput()
num_8 = ClusterInput()
num_9 = ClusterInput()
num_10 = ClusterInput()
num_11 = ClusterInput()
num_12 = ClusterInput()
num_13 = ClusterInput()
num_14 = ClusterInput()
num_15 = ClusterInput()
num_16 = ClusterInput()
num_17 = ClusterInput()
num_18 = ClusterInput()
num_19 = ClusterInput()
num_20 = ClusterInput()
num_21 = Number(num)
num_22 = Number(num_2)
num_23 = Number(num_3)
num_24 = Number(num_4)
num_25 = Number(num_5)
num_26 = Number(num_6)
num_27 = Number(num_7)
num_28 = Number(num_8)
num_29 = Number(num_9)
num_30 = Number(num_10)
num_31 = Number(num_11)
num_32 = Number(num_12)
num_33 = Number(num_13)
num_34 = Number(num_14)
num_35 = Number(num_15)
num_36 = Number(num_16)
num_37 = Number(num_17)
num_38 = Number(num_18)
num_39 = Number(num_19)
num_40 = Number(num_20)
num_41 = Number([num_22, num_24, num_26, num_28, num_32])
num_42 = Number([num_30, num_33, num_34, num_36, num_37])
num_43 = Number([num_25, num_23, num_21, num_27, num_29])
vector_xyz = VectorXYZ(XComponent=0, YComponent=0, ZComponent=num_39)  # -> Vector, Length
chosen_points_s_indices_for_line_creatio = Number(num_43)  # "Chosen points's indices for line creation"
chosen_points_s_indices_for_line_creatio_2 = Number(num_41)  # "Chosen points's indices for line creation"
number_slider = Slider(20, range=0..100)

multiplication = Multiplication(A=num_40, B=number_slider)
division = Division(A=multiplication, B=2)
vector_xyz_2 = VectorXYZ(XComponent=division, YComponent=division, ZComponent=0)  # -> Vector, Length
construct_point = ConstructPoint(XCoordinate=0, YCoordinate=0, ZCoordinate=num_38)
vector_xyz_3 = VectorXYZ(XComponent=0, YComponent=0, ZComponent=0)  # -> Vector, Length
move = Move(Geometry=construct_point, Motion=vector_xyz_3.Vector)  # -> Geometry, Transform
reverse = Reverse(Vector=vector_xyz_2.Vector)

move_2 = Move(Geometry=move.Geometry, Motion=vector_xyz.Vector)  # -> Geometry, Transform
bottombase = Point(vector_xyz_3.Vector)
midbase = Point(move.Geometry)
topbase = Point(move_2.Geometry)
top_level_base_point_of_grid = Point(topbase)
number_slider_2 = Slider(4, range=0..100)
number_slider_3 = Slider(4, range=0..100)
base_point_of_grid = Point(midbase)
number_slider_4 = Slider(4, range=0..10)
base_point_of_grid_2 = Point(bottombase)
number_slider_5 = Slider(4, range=0..10)
chosen_points_s_indices_for_line_creatio_3 = Number(num_42)  # "Chosen points's indices for line creation"
lng = ListLength(List=[chosen_points_s_indices_for_line_creatio_2, chosen_points_s_indices_for_line_creatio_3, chosen_points_s_indices_for_line_creatio])
number_slider_6 = Slider(4, range=0..10)
lng_2 = ListLength(List=chosen_points_s_indices_for_line_creatio)
lng_3 = ListLength(List=chosen_points_s_indices_for_line_creatio_2)
lng_4 = ListLength(List=chosen_points_s_indices_for_line_creatio_3)
neg = Negative(Value=num_35)
multiplication_2 = Multiplication(A=lng, B=2)
addition = Addition(A=lng_2, B=lng_3)
vb = VBScript(Genelist="Metaball Radii", Count=multiplication_2, MinVal=num_35, MaxVal=neg, DecimalPlaces=Slider(2, range=0..3))  # -> out
# ---------- vb: VB ----------
    For Each obj As IGH_DocumentObject In owner.OnPingDocument().Objects
      If (obj.ComponentGuid <> New Guid("{21553c44-ea62-475e-a8bb-62b2a3ee5ca5}")) Then
        Continue For
      Else
        If (obj.NickName Like genelist) Then
          CallByName(obj, "Count", CallType.Set, count)
          CallByName(obj, "Minimum", CallType.Set, MinVal)
          CallByName(obj, "Maximum", CallType.Set, MaxVal)
          CallByName(obj, "Decimals", CallType.Set, DecimalPlaces)
          If Randomize = True Then
            For idx As int32 = 0 To Count - 1
              Dim Dom As New Interval(MinVal, MaxVal)
              CallByName(obj, "Value", CallType.Set, idx, Dom.ParameterAt(Rnd()))
            Next idx
          End If
          CallByName(obj, "ExpireSolution", CallType.Method, True)
        End If
      End If
    Next
# ---------- end vb ----------
multiplication_3 = Multiplication(A=lng_2, B=2)
panel = Panel(chosen_points_s_indices_for_line_creatio)
panel_2 = Panel(chosen_points_s_indices_for_line_creatio_2)
panel_3 = Panel(chosen_points_s_indices_for_line_creatio_3)
multiplication_4 = Multiplication(A=addition, B=2)
metaball_radii = GenePool(
    Decimals=2,
    Maximum=0,
    Minimum=0,
    Value=[0, 0, 0, 0, 0, 0, 0, 0, 0, 0, 0, 0, 0, 0, 0, 0, 0, 0, 0, 0, 0, 0, 0, 0, 0, 0, 0, 0, 0, 0])
series = Series(Start=0, Step=2, Count=lng_2)
series_2 = Series(Start=multiplication_3, Step=2, Count=lng_3)
addition_2 = Addition(A=series, B=1)
series_3 = Series(Start=multiplication_4, Step=2, Count=lng_4)
addition_3 = Addition(A=series_2, B=1)
addition_4 = Addition(A=series_3, B=1)
item = ListItem(List=metaball_radii, Index=addition_3, Wrap=True)
item_2 = ListItem(List=metaball_radii, Index=series_3, Wrap=True)
item_3 = ListItem(List=metaball_radii, Index=series, Wrap=True)
item_4 = ListItem(List=metaball_radii, Index=series_2, Wrap=True)
item_5 = ListItem(List=metaball_radii, Index=addition_4, Wrap=True)
item_6 = ListItem(List=metaball_radii, Index=addition_2, Wrap=True)
x_displacement_2_values = Number(item_3)
x_displacement_2 = Number(x_displacement_2_values)
panel_4 = Panel(x_displacement_2)
y_displacement_2_values = Number(item_6)
y_displacement_2 = Number(y_displacement_2_values)
panel_5 = Panel(y_displacement_2)
top_level_curve_generation_system = TopLevelCurveGenerationSystem(
    G=top_level_base_point_of_grid,
    X=number_slider,
    X_2=num_40,
    Y=num_40,
    z_component=Slider(19, range=0..100),
    num=panel,
    x_displacement2=panel_4,
    y_displacement_2=panel_5)  # -> start, end, G_3, G_2, Q, i
bottom_points = Point(flatten(top_level_curve_generation_system.end))
top_points = Point(flatten(top_level_curve_generation_system.start))
crv = Curve(flatten([top_level_curve_generation_system.G_2, top_level_curve_generation_system.Q]))
x_displacement_1_values = Number(item_4)
x_displacement_1 = Number(x_displacement_1_values)
panel_6 = Panel(x_displacement_1)
y_displacement_1_values = Number(item)
y_displacement_1 = Number(y_displacement_1_values)
panel_7 = Panel(y_displacement_1)
mid_level_curve_generation_system = MidLevelCurveGenerationSystem(
    G=base_point_of_grid,
    X=Slider(20, range=0..20),
    number=num_40,
    number_2=num_40,
    z_component=Slider(22, range=0..100),
    num=panel_2,
    X_2=panel_6,
    Y=panel_7)  # -> G_2, start, end, i, G_3
cluster = Cluster(points=flatten(mid_level_curve_generation_system.start))
start_points = Point(flatten(mid_level_curve_generation_system.end))
top_points_2 = Point(flatten(mid_level_curve_generation_system.start))
crv_2 = Curve(flatten(mid_level_curve_generation_system.G_3))
x_displacement_3_values = Number(item_2)
x_displacement_3 = Number(x_displacement_3_values)
panel_8 = Panel(x_displacement_3)
y_displacement_3_values = Number(item_5)
y_displacement_3 = Number(y_displacement_3_values)
panel_9 = Panel(y_displacement_3)
bottom_level_curve_generation_system = BottomLevelCurveGenerationSystem(
    G=base_point_of_grid_2,
    X=Slider(20, range=0..20),
    X_2=num_40,
    Y=num_40,
    z_component=Slider(22, range=0..100),
    num=panel_3,
    X_3=panel_8,
    Y_2=panel_9)  # -> G_2, start, end, i, G_3
start_points_2 = Point(flatten(bottom_level_curve_generation_system.end))
top_points_3 = Point(flatten(bottom_level_curve_generation_system.start))
crv_3 = Curve(flatten(bottom_level_curve_generation_system.G_3))
pt = Point(cluster)
pt_2 = Point([mid_level_curve_generation_system.G_2, top_level_curve_generation_system.G_3, bottom_level_curve_generation_system.G_2])
cps = ClosestPoints(Point=bottom_points, Cloud=top_points_2, Count=Slider(3, range=0..10))  # -> graft(ClosestPoint), CPIndex, Distance
cps_2 = ClosestPoints(Point=top_points_3, Cloud=start_points, Count=Slider(3, range=0..10))  # -> graft(ClosestPoint), CPIndex, Distance
ln = Line(StartPoint=flatten(bottom_points), EndPoint=cps.ClosestPoint)  # -> flatten(Line)
ln_2 = Line(StartPoint=flatten(top_points_3), EndPoint=cps_2.ClosestPoint)  # -> flatten(Line)
dupln = RemoveDuplicateLines(Lines=ln, Tolerance=0.01)  # -> flatten(UniqueLines)
dupln_2 = RemoveDuplicateLines(Lines=ln_2, Tolerance=0.01)  # -> flatten(UniqueLines)
total_network_of_curves = Curve([dupln, crv_3, crv, dupln_2, crv_2])
topo = Topologizer(
    LinesInput=total_network_of_curves,
    FixPoints=[start_points_2, top_points, bottom_points, top_points_3, top_points_2, start_points],
    Tolerance=num_31)  # -> flatten(L), P, S, E, N, I, O, G
number_slider_7 = Slider(3, range=0..10)
crv_4 = Curve(topo.L)
line_to_mesh = ExoWireframe(
    Lines=crv_4,
    Sides=Slider(12, range=0..100),
    StartRadius=number_slider_7,
    EndRadius=number_slider_7,
    NodeDepth=Slider(0, range=0..10),
    Division=Slider(20, range=0..1000),
    Open=False)
lng_5 = ListLength(List=crv_4)
wblaplace = WeaverbirdsLaplacianSmoothing(MeshCurves=line_to_mesh, Level=Slider(4, range=0..10), SmoothNakedEdges=1, Thin=1)
number_ofnetworkcurves = Panel("NumberOfNetworkCurves")
levelm_indices = Panel("MLevel_Indices")
levelt_indices = Panel("TLevel_Indices")
levelb_indices = Panel("BLevel_Indices")
totalarea = Panel("TotalArea")
population = Panel("PotentialPopulation")
deflection = Panel("MaximumDeflection")
stress = Panel("AverageStressOnSkin(kn/m2)")
wboffset = WeaverbirdsOffsetMesh(MeshCurves=wblaplace, Distance=Slider(1.5, range=0..2), OffsetType=0)
mesh = Mesh(wboffset)
medges = MeshEdges(Mesh=mesh)  # -> NakedEdges, InteriorEdges, NonManifoldEdges
geo = Geometry(mesh)
vec = VectorXYZ(XComponent=Slider(120, range=0..1000), YComponent=0, ZComponent=0)  # -> Vector, Length
vector_xyz_4 = VectorXYZ(XComponent=0, YComponent=0, ZComponent=2)  # -> Vector, Length
calculatearea = BooleanToggle(True)
geo_2 = ClusterOutput(geo)
cull = CullPattern(List=wboffset, CullPattern=calculatearea)
contour = Contour(Shape=cull, Point=vector_xyz_4.Vector, Direction=Vector(0, 0, 1), Distance=Slider(1, range=0..100))
vec_2 = VectorXYZ(XComponent=0, YComponent=0, ZComponent=0.1)  # -> Vector, Length; disabled
extr = Extrude(Base=contour, Direction=vec_2.Vector)  # disabled
area = Area(Geometry=contour)  # -> flatten(Area), Centroid
cap = CapHoles(Brep=extr)  # disabled
people_per_m2 = Slider(8, range=0..10)
mass_addition = MassAddition(Input=area.Area)  # -> flatten(Result), PartialResults
multiplication_5 = Multiplication(A=mass_addition.Result, B=16)
totalarea_2 = Panel(multiplication_5)
division_2 = Division(A=totalarea_2, B=people_per_m2)
int = Integer(division_2)
number_of_occupants = Panel(int)

deflection_show_multiplier = Slider(20, range=0..20)
perfomstructuralanalysis = BooleanToggle(False)
mesh_2 = Mesh(mesh)
percentage = Panel("40")
item_7 = ListItem(List=start_points_2, Index=0, Wrap=True)
pdecon = Deconstruct(Point=item_7)  # -> XComponent, YComponent, ZComponent
addition_5 = Addition(A=pdecon.ZComponent, B=Slider(15, range=0..50))
mat = Material(MaterialType=5)
mat_2 = SupportType(X=True, Y=True, Z=True, RX=True, RY=True, RZ=True)

cull_2 = CullPattern(List=mesh_2, CullPattern=perfomstructuralanalysis)

reducemesh = CSharpScript(M=cull_2, P=percentage)  # -> out, A; inputs M: Mesh, P: Double
# ---------- reducemesh: C# ----------
    if(M != null){
      Guid meshObj = doc.Objects.AddMesh(M);
      doc.Objects.UnselectAll();
      doc.Objects.Select(meshObj);
      Rhino.RhinoApp.RunScript("_-ReduceMesh _ReductionPercentage " + Convert.ToString(P) + " _Enter", false);
      Rhino.DocObjects.RhinoObject MObj = doc.Objects.GetSelectedObjects(false, false).First();
      doc.Objects.Delete(meshObj, true);
      A = MObj.Geometry;
    }
# ---------- end reducemesh ----------
demesh = DeconstructMesh(Mesh=reducemesh.A)  # -> Vertices, Faces, Colours, Normals
pdecon_2 = Deconstruct(Point=demesh.Vertices)  # -> XComponent, YComponent, ZComponent
smaller = SmallerThan(FirstNumber=pdecon_2.ZComponent, SecondNumber=addition_5)  # -> SmallerThan, OrEqualTo
cull_3 = CullPattern(List=demesh.Vertices, CullPattern=smaller.SmallerThan)
femesh = FEMesh(Meshes=reducemesh.A, Material=mat, Thickness=Slider(1.1, range=0.1..10), AreaLoad=Vector(0, 0, 0), NormalAreaLoad=0)
fepointsupports = FEPointSupports(Point=cull_3, SupportType=mat_2)

fea_system = FEASystem(
    ModelComponents=flatten([femesh, fepointsupports]),
    IntersectAddedCurves=True,
    MergeTolerance=0.0001,
    MinimumCurveSpan=0.05,
    MaximumCurveSpan=10000,
    CurveTolerance=0.1)

fe_solver = FESolver(
    FEModel=fea_system,
    SelfWeightCoefficient=1,
    BeamOptimisationIterations=0,
    QuadOptimisationIterations=0,
    OptimizationTarget=0.3,
    OptimizationPenalization=2,
    LoadCase=0,
    AllCases=True)  # -> FEModel, MaxDeflection, Weight
division_3 = Division(A=deflection_show_multiplier, B=fe_solver.MaxDeflection)
mesh_visualization = MeshVisualization(FEModel=fe_solver.FEModel, Deflection=division_3, Plane=1, ShowThickness=False, ColorMode=1)  # -> Mesh, CompleteRange, VisibleRange
dedomain = DeconstructDomain(Domain=mesh_visualization.CompleteRange)  # -> Start, End
avr = Average(Input=flatten([dedomain.End, dedomain.Start]))
int_2 = Integer(avr)
maximum_deflection_m = Panel(fe_solver.MaxDeflection)
average_of_stress_range_kn_m2 = Panel(int_2)

data = Data([number_ofnetworkcurves, lng_5, levelb_indices, num_42, levelm_indices, num_41, levelt_indices, num_43, totalarea, multiplication_5, population, int, stress, int_2, deflection, maximum_deflection_m])
mesh_3 = Mesh(mesh_visualization.Mesh)
data_2 = ClusterOutput(data)
move_3 = Move(Geometry=[mesh_3, medges.InteriorEdges], Motion=vec.Vector)  # -> Geometry, Transform

# ==== cluster TopLevelCurveGenerationSystem
z_component = ClusterInput()
X = ClusterInput()
G = ClusterInput()
X_2 = ClusterInput()
Y = ClusterInput()
x_displacement2 = ClusterInput()
y_displacement_2 = ClusterInput()
vector_xyz = VectorXYZ(XComponent=0, YComponent=0, ZComponent=z_component)  # -> Vector, Length
number_slider = Slider(20, range=0..20)
num = ClusterInput()
x_displacement2_2 = Number(x_displacement2)
y_displacement_2_2 = Number(y_displacement_2)
rectangle = Rectangle(Plane=PlaneXY(0, 0, 0), XSize=X, YSize=X, Radius=0)  # -> Rectangle, Length
num_2 = Number(num)
arrrec = RectangularArray(Geometry=G, Cell=rectangle.Rectangle, XCount=X_2, YCount=Y)  # -> Geometry, Transform
list_item = ListItem(List=arrrec.Geometry, Index=graft(num_2), Wrap=False)
panel = Panel(num_2)
clean = CleanTree(RemoveNulls=True, RemoveInvalid=True, RemoveEmpty=True, Tree=list_item)
move = Move(Geometry=clean, Motion=vector_xyz.Vector)  # -> Geometry, Transform
vec = VectorXYZ(XComponent=x_displacement2_2, YComponent=y_displacement_2_2, ZComponent=0)  # -> Vector, Length
pt = Point(clean)
line = Line(StartPoint=move.Geometry, EndPoint=clean)  # -> flatten(Line)
move_2 = Move(Geometry=line, Motion=vec.Vector)  # -> Geometry, Transform
index = ItemIndex(List=arrrec.Geometry, Item=arrrec.Geometry)
vec_2 = VectorXYZ(XComponent=0, YComponent=0, ZComponent=Slider(25, range=0..100))  # -> Vector, Length
G_2 = ClusterOutput(move_2.Geometry)
end_points = EndPoints(Curve=move_2.Geometry)  # -> Start, End
tag = TextTag3D(
    Location=arrrec.Geometry,
    Text=index,
    Size=Slider(4, range=0..10),
    Colour=ColourSwatch(SwatchColor=RGB(0, 0, 0)),
    Justification=7)
top_points = Point(flatten(end_points.Start))
prox = Proximity3D(Points=top_points, Group=Slider(2, range=0..10))  # -> flatten(Links), Topology
item = ListItem(List=top_points, Index=prox.Topology, Wrap=True)
end = ClusterOutput(end_points.End)
start = ClusterOutput(end_points.Start)
G_3 = ClusterOutput(arrrec.Geometry)

end_2 = EndPoints(Curve=prox.Links)  # -> Start, End

pt_2 = Point(graft(end_2.Start))
pt_3 = Point(graft(end_2.End))
move_3 = Move(Geometry=end_2.Start, Motion=vec_2.Vector)  # -> graft(Geometry), Transform
move_4 = Move(Geometry=end_2.End, Motion=vec_2.Vector)  # -> graft(Geometry), Transform

nurbs = NurbsCurve(Vertices=[pt_2, move_3.Geometry, move_4.Geometry, pt_3], Degree=3, Periodic=False)  # -> Curve, Length, Domain
pline = PolyLine(Vertices=[pt_2, move_3.Geometry, move_4.Geometry, pt_3], Closed=False)
reb = RebuildCurve(Curve=nurbs.Curve, Degree=1, Count=Slider(4, range=0..10), Tangents=False)
explode = Explode(Curve=reb, Recursive=True)  # -> flatten(Segments), Vertices
dupln = RemoveDuplicateLines(Lines=explode.Segments, Tolerance=0.01)  # -> flatten(UniqueLines)

divide = DivideCurve(Curve=nurbs.Curve, Count=Slider(2, range=0..10), Kinks=False)  # -> ReachingPoints, Tangents, Parameters
item_2 = ListItem(List=divide.ReachingPoints, Index=Slider(1, range=0..100), Wrap=True)  # -> flatten(Item)
Q = ClusterOutput(dupln)
i = ClusterOutput(item_2)

# ==== cluster MidLevelCurveGenerationSystem
number = ClusterInput()
X = ClusterInput()
number_2 = ClusterInput()
num = ClusterInput()
X_2 = ClusterInput()
Y = ClusterInput()
z_component = ClusterInput()
number_3 = Number(number)
number_4 = Number(number_2)
G = ClusterInput()

rectangle = Rectangle(Plane=PlaneXY(0, 0, 0), XSize=X, YSize=X, Radius=0)  # -> Rectangle, Length
arrrec = RectangularArray(Geometry=G, Cell=rectangle.Rectangle, XCount=number_3, YCount=number_4)  # -> Geometry, Transform
num_2 = Number(num)
vec = VectorXYZ(XComponent=X_2, YComponent=Y, ZComponent=0)  # -> Vector, Length
vector_xyz = VectorXYZ(XComponent=0, YComponent=0, ZComponent=z_component)  # -> Vector, Length
list_item = ListItem(List=arrrec.Geometry, Index=graft(num_2), Wrap=False)
index = ItemIndex(List=arrrec.Geometry, Item=arrrec.Geometry)

G_2 = ClusterOutput(arrrec.Geometry)
index_2 = ItemIndex(List=arrrec.Geometry, Item=arrrec.Geometry)
i = ClusterOutput(index)
clean = CleanTree(RemoveNulls=True, RemoveInvalid=True, RemoveEmpty=True, Tree=list_item)
tag = TextTag3D(
    Location=arrrec.Geometry,
    Text=index_2,
    Size=Slider(4, range=0..10),
    Colour=ColourSwatch(SwatchColor=RGB(0, 0, 0)),
    Justification=7)

move = Move(Geometry=clean, Motion=vector_xyz.Vector)  # -> Geometry, Transform
line = Line(StartPoint=move.Geometry, EndPoint=clean)  # -> flatten(Line)
move_2 = Move(Geometry=line, Motion=vec.Vector)  # -> Geometry, Transform
end_points = EndPoints(Curve=move_2.Geometry)  # -> Start, End

G_3 = ClusterOutput(move_2.Geometry)
start = ClusterOutput(end_points.Start)
end = ClusterOutput(end_points.End)

# ==== cluster BottomLevelCurveGenerationSystem
X = ClusterInput()
z_component = ClusterInput()
G = ClusterInput()
X_2 = ClusterInput()
Y = ClusterInput()
X_3 = ClusterInput()
Y_2 = ClusterInput()
num = ClusterInput()

vec = VectorXYZ(XComponent=X_3, YComponent=Y_2, ZComponent=0)  # -> Vector, Length
num_2 = Number(num)
rectangle = Rectangle(Plane=PlaneXY(0, 0, 0), XSize=X, YSize=X, Radius=0)  # -> Rectangle, Length
vector_xyz = VectorXYZ(XComponent=0, YComponent=0, ZComponent=z_component)  # -> Vector, Length
arrrec = RectangularArray(Geometry=G, Cell=rectangle.Rectangle, XCount=X_2, YCount=Y)  # -> Geometry, Transform
list_item = ListItem(List=arrrec.Geometry, Index=graft(num_2), Wrap=False)

index = ItemIndex(List=arrrec.Geometry, Item=arrrec.Geometry)
clean_tree = CleanTree(Tree=list_item, CleanInvalid=True, CleanEmpty=True)
G_2 = ClusterOutput(arrrec.Geometry)

index_2 = ItemIndex(List=arrrec.Geometry, Item=arrrec.Geometry)

move = Move(Geometry=clean_tree, Motion=vector_xyz.Vector)  # -> Geometry, Transform
line = Line(StartPoint=move.Geometry, EndPoint=clean_tree)  # -> flatten(Line)
move_2 = Move(Geometry=line, Motion=vec.Vector)  # -> Geometry, Transform
end_points = EndPoints(Curve=move_2.Geometry)  # -> Start, End

i = ClusterOutput(index_2)
tag = TextTag3D(
    Location=arrrec.Geometry,
    Text=index,
    Size=Slider(4, range=0..10),
    Colour=ColourSwatch(SwatchColor=RGB(0, 0, 0)),
    Justification=7)
G_3 = ClusterOutput(move_2.Geometry)
start = ClusterOutput(end_points.Start)
end = ClusterOutput(end_points.End)

# ==== cluster Cluster
points = ClusterInput()
proximity_3d = Proximity3D(Points=points, Group=5)  # -> Links, Topology
divide_curve = DivideCurve(Curve=proximity_3d.Links, Count=Slider(2, range=0..10), Kinks=False)  # -> Points, Tangents, Parameters
list_item = ListItem(List=divide_curve.Points, Index=1, Wrap=True)  # -> flatten(Item)
cull_duplicates = CullDuplicates(Points=list_item, Tolerance=0.1, CullMode=3)  # -> Points, Indices, Valence
points_2 = ClusterOutput(cull_duplicates.Points)
