# Grasshopper definition HystEng2.0.ghx (Grasshopper 0.9.76)
# plug-ins: Python Interpreter

reset = Button()

file = ReadFile(File="C:\Users\Arefin\Documents\hysteresis-server\received\restore.json", PerLineParse=False)
record = Button()
path = FilePath("C:\Users\Arefin\Documents\hysteresis-server\public\data.dat")
path_2 = FilePath(path)
txt = Text("ReactorGen")
data_grabber = PythonScript(node_name=txt, path=path_2, record=record, reset=reset)  # inputs record: Boolean
# ---------- data_grabber: Python ----------
import Grasshopper as gh
import os

ghObjects = ghenv.Component.OnPingDocument().Objects
d = dict()
key_list = []
if record:
    for obj in ghObjects:
        if obj.NickName == node_name.ToString():
            value_list = []
            for input in obj.Params.Input:
                if input.Sources[0].NickName:
                    key = input.Sources[0].NickName
                else:
                    input.Sources[0].NickName = input.NickName
                    key = input.Sources[0].NickName
                value = input.Sources[0].Slider.Value.ToDouble(input.Sources[0].Slider.Value)
                d[key] = value
                value_list.append(value)
    if len(d)>0:
#        d_vector = value_list
        print d
        if os.path.exists(path):
            f = open(path,'a')
            f.write(str(d))
            f.write('\n')
        else:
            f = open(path,'w')
            f.write(str(d))
            f.write('\n')
        f.close()
 
if reset:
    f = open(path,'w')
    f.write('')
    f.close()
        
#for obj in ghObjects:
#    if obj.NickName == node_name.ToString():
#        value_list = []
#        for input in obj.Params.Input:
#            key_list.append(input.NickName)
#
#length = int(len(key_list))
# ---------- end data_grabber ----------
restore_state = PythonScript(file=file, node_name=txt)
# ---------- restore_state: Python ----------
import json
state = json.loads(file)

ghObjects = ghenv.Component.OnPingDocument().Objects
for obj in ghObjects:
    if obj.NickName == node_name:
        for input in obj.Params.Input:
            value = state['params'][input.NickName]
            input.Sources[0].Slider.Value = value
        obj.ExpireSolution(True)
# ---------- end restore_state ----------
file_2 = ReadFile(F=path_2, PerLineParse=True)  # -> C
#   port F: Uri of file to read
# ---------- file_2: VB line parser ----------
    action = GH_LineParserAction.Include
    Return line

    'Parse the line and return some data that represents the line.
    'If the line cannot be parsed, you can return Nothing and
    'assign a different action.
    'The default implementation is to just return the line itself.
    'If you return types that implement IGH_Goo, this component
    'will work substantially faster.
# ---------- end file_2 ----------
send_to_gallery = Button()
index = ControlKnob(Decimals=0, Limit=False, Maximum=10, Minimum=0, Range=10, Value=72)
magicbox = PythonScript(node_name=txt, data=simplify(file_2), send=send_to_gallery, index=index)  # inputs data: list
# ---------- magicbox: Python ----------
import json
import itertools
import Grasshopper as gh
from System import Guid
from scriptcontext import doc
import os
import time

path = "C:/Users/Arefin/Documents/hysteresis-server/public/json/"
path_kernel = "C:/Users/Arefin/Documents/hysteresis-server/received/"
keylist = []
valuelist = []

def chunks(l, n):
    """Yield successive n-sized chunks from l."""
    for i in xrange(0, len(l), n):
        yield l[i:i+n]

def create_flipdict(data):
    veclist = []
    # turn strings into dicts
    for item in data:
        vec = eval(item)
        veclist.append(vec)
    
    flipdict = dict()    
    # get the names of keys to iterate over 
    for vec in veclist:   
        for key in vec:
            flipdict[key] = []
    
    #accumulate
    for key in flipdict:
        for vec in veclist:
            if key in vec:
                flipdict[key].append(vec[key])
    return flipdict                

def create_matrix(flipdict):
        
    #create matrix 
    matrix = []       
    for key in flipdict:
        matrix.append(set(flipdict[key]))
    return matrix

def generate_cproduct(matrix):
    #cartesian product
    product = []
    for item in itertools.product(*matrix):
        product.append(item)
    return product

def get_alt(index, productlist,flipdict):
    i = int(index)%(len(productlist)) 
    selection = productlist[i]    
    rvec = dict()    
    nkeylist = []
    for key in flipdict:
        nkeylist.append(key)
    for key,value in zip(nkeylist,selection):
        rvec[key] = value
    return rvec

def update_model(rvec, node_name):
    ghObjects = ghenv.Component.OnPingDocument().Objects
    for obj in ghObjects:
        if obj.NickName == d_node_name:
            for input in obj.Params.Input:
                value = rvec[input.NickName]
                input.Sources[0].Slider.Value = value
            obj.ExpireSolution(True)
    print "Updated "+node_name

def send_to_gallery(data,send):
    if send:
        json_data = dict()
    
        uid = str(Guid.NewGuid())
        json_data['params'] = rvec
        json_data['uid'] = uid
        json_data['cad_file'] = 'xyz.obj'
        json_data['image'] = path+uid+'.bmp'
    
        with open(path+uid+'.json','w') as outfile:
            json.dump(json_data, outfile, indent=2)
        
        bitmap = doc.Views.ActiveView.CaptureToBitmap(True, True, True)
        bitmap.Save(path+uid+'.bmp')
        print "Sent "+uid+" to gallery"

d_node_name = '2'+node_name

# Generate cartesian product from Rhino/GH input 
# and send to gallery on click

flipdict = create_flipdict(data)
matrix = create_matrix(flipdict)
cproduct = generate_cproduct(matrix)
alt = get_alt(index, cproduct, flipdict)
update_model(alt,d_node_name)
if send:
    send_to_gallery(alt,send)
    
# Generate cart. prod. from new kernel and slowly send to gallery

# Read file

if os.path.exists(path_kernel+'kernel.json'):
    f = open(path_kernel+'kernel.json','r')
    data = f.read()
    f.close()
    if len(data)>0:
        # parse the data into dict
        kernel = eval(data)
        #erase the file contents to prevent infinite loop
        f = open(path_kernel+'kernel.json','w')
        f.write('')
        f.close()
        
        _matrix = create_matrix(kernel)
        _cproduct = generate_cproduct(_matrix)
        
        #now iterate over _cproduct and update model
        #then wait for 1 sec and take snapshot, send to gall
        
        for i in range(len(_cproduct)):
            _alt = get_alt(i, _cproduct, kernel)
            update_model(_alt,d_node_name)
            time.sleep(1)
            send_to_gallery(_alt, True)
            time.sleep(1)
# ---------- end magicbox ----------
