# Grasshopper definition hysteresis2.0.ghx (Grasshopper 0.9.76)
# plug-ins: Python Interpreter, Flux

panel = Panel("DO NOT MODIFY")

outputshape_seg = Slider(8, range=3..8)
gridtype = Slider(1, range=0..4)
pointy = Slider(1, range=0..1)
attf_x = Slider(0, range=0..2)
scale = Slider(6, range=1..15)
outputshape = Slider(1, range=0..1)
pointx = Slider(0.9, range=0..1)
angle = Slider(8, range=0..100)

outputshape_seg_2 = Slider(3, range=3..8)
gridtype_2 = Slider(1, range=0..4)
pointy_2 = Slider(1, range=0..1)
attf_x_2 = Slider(0, range=0..2)
scale_2 = Slider(6, range=1..15)
outputshape_2 = Slider(1, range=0..1)
pointx_2 = Slider(0.9, range=0..1)
angle_2 = Slider(8, range=0..100)

reactorgen = ReactorGen(G=gridtype, G_2=attf_x, G_3=outputshape, S=outputshape_seg, A=pointx, A_2=pointy, B=scale, A_3=angle)
geo = Geometry(reactorgen)

_2reactorgen = ReactorGen(G=gridtype_2, G_2=attf_x_2, G_3=outputshape_2, S=outputshape_seg_2, A=pointx_2, A_2=pointy_2, B=scale_2, A_3=angle_2)  # disabled
geo_2 = Geometry(_2reactorgen)
move = Move(Geometry=geo_2, Motion=Vector(166, 0, 0))  # -> Geometry, Transform

flux = FluxProject(project="a9jAyvE70YL3qR5WZ")  # -> Keys, Meta
flow_control = FlowControl({"Once", "Constantly"}, selected="Constantly")
from_flux = FromFlux(
    Keys=flux.Keys,
    Mode=flow_control,
    keyId="40cb7ce2f54c0b988a90e04600d8d638",
    mode="Constantly",
    Branch0_Path="{0;0;0}",
    Branch0_Item0_EdgeIndex=-1,
    Branch0_Item0_TypeName="Grasshopper.Kernel.Types.GH_Curve",
    Branch0_Item1_EdgeIndex=-1,
    Branch0_Item1_TypeName="Grasshopper.Kernel.Types.GH_Curve",
    Branch0_Item2_EdgeIndex=-1,
    Branch0_Item2_TypeName="Grasshopper.Kernel.Types.GH_Curve",
    Branch0_Item3_EdgeIndex=-1,
    Branch0_Item3_TypeName="Grasshopper.Kernel.Types.GH_Curve",
    Branch0_Item4_EdgeIndex=-1,
    Branch0_Item4_TypeName="Grasshopper.Kernel.Types.GH_Curve",
    Branch0_Item5_EdgeIndex=-1,
    Branch0_Item5_TypeName="Grasshopper.Kernel.Types.GH_Curve",
    Branch0_Item6_EdgeIndex=-1,
    Branch0_Item6_TypeName="Grasshopper.Kernel.Types.GH_Curve",
    Branch0_Item7_EdgeIndex=-1,
    Branch0_Item7_TypeName="Grasshopper.Kernel.Types.GH_Curve",
    Branch0_Item8_EdgeIndex=-1,
    Branch0_Item8_TypeName="Grasshopper.Kernel.Types.GH_Curve",
    Branch0_Item9_EdgeIndex=-1,
    Branch0_Item9_TypeName="Grasshopper.Kernel.Types.GH_Curve",
    Branch0_Item10_EdgeIndex=-1,
    Branch0_Item10_TypeName="Grasshopper.Kernel.Types.GH_Curve",
    Branch0_Item11_EdgeIndex=-1,
    Branch0_Item11_TypeName="Grasshopper.Kernel.Types.GH_Curve",
    Branch0_Item12_EdgeIndex=-1,
    Branch0_Item12_TypeName="Grasshopper.Kernel.Types.GH_Curve",
    Branch0_Item13_EdgeIndex=-1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)  # -> Value, Meta
move_2 = Move(Geometry=from_flux.Value, Motion=Vector(166, 0, 0))  # -> Geometry, Transform
getdirectory = PythonScript()  # -> dir, file_name, full_path
# ---------- getdirectory: Python ----------
import os
fn = ghenv.Component.OnPingDocument()
file_name = (str(fn)).strip("*")
print file_name

full_path = (ghenv.Component.OnPingDocument().FilePath)

dir = full_path.replace(file_name+".ghx","")
print dir
print full_path
# ---------- end getdirectory ----------
reset = Button()
hysteng2_0 = HystEng20()
restorefile = PythonScript(path=getdirectory.dir)  # -> restorefile
# ---------- restorefile: Python ----------
import os

pardir = os.path.abspath(os.path.join(path, os.pardir))

restorefile = os.path.join(pardir, "received"+os.path.sep+"restore.json")
print restorefile
# ---------- end restorefile ----------
datafile = PythonScript(path=getdirectory.dir)  # -> datafile
# ---------- datafile: Python ----------
import os
datafile = os.path.join(path, "data.dat")
print datafile
# ---------- end datafile ----------
start = Button()

index = ControlKnob(Decimals=0, Limit=False, Maximum=10, Minimum=0, Range=10, Value=24)
record = Button()
file = ReadFile(File=restorefile, PerLineParse=False)
file_2 = ReadFile(F=datafile, PerLineParse=True)  # -> C; same code as file_2
data_grabber = PythonScript(node_name="ReactorGen", path=datafile, record=record, reset=reset)  # inputs record: Boolean
# ---------- data_grabber: Python ----------
import Grasshopper as gh
import os
#path1 = os.path.dirname(path)
#print path1
#path.replace("public\","data.dat")
print path
ghObjects = ghenv.Component.OnPingDocument().Objects
d = dict()
key_list = []
if record:
    for obj in ghObjects:
        if obj.NickName == node_name.ToString():
            value_list = []
            for input in obj.Params.Input:
                if input.Sources[0].NickName:
                    key = input.Sources[0].NickName
                else:
                    input.Sources[0].NickName = input.NickName
                    key = input.Sources[0].NickName
                value = input.Sources[0].Slider.Value.ToDouble(input.Sources[0].Slider.Value)
                d[key] = value
                value_list.append(value)
    if len(d)>0:
#        d_vector = value_list
        print d
        if os.path.exists(path):
            f = open(path,'a')
            f.write(str(d))
            f.write('\n')
        else:
            f = open(path,'w')
            f.write(str(d))
            f.write('\n')
        f.close()
 
if reset:
    f = open(path,'w')
    f.write('')
    f.close()
        
#for obj in ghObjects:
#    if obj.NickName == node_name.ToString():
#        value_list = []
#        for input in obj.Params.Input:
#            key_list.append(input.NickName)
#
#length = int(len(key_list))
# ---------- end data_grabber ----------
restore_state = PythonScript(file=file, node_name="ReactorGen")  # same code as restore_state
send_to_gallery = Button()
magicbox = PythonScript(node_name="ReactorGen", data=simplify(file_2), index=index)  # -> matrix, keys, index, alt; inputs data: list
# ---------- magicbox: Python ----------
import json
import cPickle
import itertools
import Grasshopper as gh
from System import Guid
from scriptcontext import doc
import os
import time

keylist = []
valuelist = []

#def chunks(l, n):
#    """Yield successive n-sized chunks from l."""
#    for i in xrange(0, len(l), n):
#        yield l[i:i+n]
#        
#def get_node(name):
#    ghObjects = ghenv.Component.OnPingDocument().Objects
#    for obj in ghObjects:
#        if obj.NickName == name:
#            return obj
#    print "Node not found"

def create_flipdict(data):
    veclist = []
    # turn strings into dicts
    for item in data:
        vec = eval(item)
        veclist.append(vec)
    
    flipdict = dict()    
    # get the names of keys to iterate over 
    for vec in veclist:   
        for key in vec:
            flipdict[key] = []
    
    #accumulate
    for key in flipdict:
        for vec in veclist:
            if key in vec:
                flipdict[key].append(vec[key])
    return flipdict                

def create_matrix(flipdict):
        
    #create matrix 
    matrix = []       
    for key in flipdict:
        matrix.append(list(set(flipdict[key])))
        keylist.append(key)
    return matrix

#def generate_cproduct(matrix):
#    #cartesian product
#    product = []
#    for item in itertools.product(*matrix):
#        product.append(item)
#    return product
#
#def get_alt(index, productlist,flipdict):
#    i = int(index)%(len(productlist)) 
#    selection = productlist[i]    
#    rvec = dict()    
#    nkeylist = []
#    for key in flipdict:
#        nkeylist.append(key)
#    for key,value in zip(nkeylist,selection):
#        rvec[key] = value
#    return rvec
#
#def update_model(rvec, node):
#    for input in node.Params.Input:
#        value = rvec[input.NickName]
#        input.Sources[0].Slider.Value = value
#    node.ExpireSolution(True)
#    print "Updated "+node.NickName


# Generate cartesian product from Rhino/GH input 
# and send to gallery on click
#node = get_node(node_name)
flipdict = create_flipdict(data)
matrix = create_matrix(flipdict)
#cproduct = generate_cproduct(matrix)
#_alt = get_alt(index, cproduct, flipdict)
#repeater = get_node("2"+node_name)
#update_model(_alt,repeater)
#alt=json.dumps(_alt)
#_matrix = json.dumps(matrix)
_matrix = matrix
print _matrix
keys = keylist

#cPickle.dumps(keylist)
# ---------- end magicbox ----------
kernel2product = PythonScript(node_name="ReactorGen", dir=getdirectory.dir, trigger=start)
# ---------- kernel2product: Python ----------
import json
import itertools
import Grasshopper as gh
from System import Guid
from scriptcontext import doc
import os
import time
import Rhino
import rhinoscriptsyntax as rs

gh = Rhino.RhinoApp.GetPlugInObject("Grasshopper")

rs.EnableRedraw(True)

path = os.path.join(dir,"gallery"+os.path.sep)
#"C:/Users/Arefin/Documents/hysteresis-server/gallery/"
pardir = os.path.abspath(os.path.join(path, os.pardir))
path_kernel = os.path.join(pardir, "received"+os.path.sep)
"C:/Users/Arefin/Documents/hysteresis-server/received/"
keylist = []
valuelist = []

def chunks(l, n):
    """Yield successive n-sized chunks from l."""
    for i in xrange(0, len(l), n):
        yield l[i:i+n]

def create_flipdict(data):
    veclist = []
    # turn strings into dicts
    for item in data:
        vec = eval(item)
        veclist.append(vec)
    
    flipdict = dict()    
    # get the names of keys to iterate over 
    for vec in veclist:   
        for key in vec:
            flipdict[key] = []
    
    #accumulate
    for key in flipdict:
        for vec in veclist:
            if key in vec:
                flipdict[key].append(vec[key])
    return flipdict                

def create_matrix(flipdict):
        
    #create matrix 
    matrix = []       
    for key in flipdict:
        matrix.append(set(flipdict[key]))
    return matrix

def generate_cproduct(matrix):
    #cartesian product
    product = []
    for item in itertools.product(*matrix):
        product.append(item)
    return product

def get_alt(index, productlist,flipdict):
    i = int(index)%(len(productlist)) 
    selection = productlist[i]    
    rvec = dict()    
    nkeylist = []
    for key in flipdict:
        nkeylist.append(key)
    for key,value in zip(nkeylist,selection):
        rvec[key] = value
    return rvec

def update_model(rvec, node):
    for input in node.Params.Input:
        value = rvec[input.NickName]
        input.Sources[0].Slider.Value = value
    node.ExpireSolution(False)
    print "Updated "+node.NickName
    
def get_node(name):
    ghObjects = ghenv.Component.OnPingDocument().Objects
    for obj in ghObjects:
        if obj.NickName == name:
            return obj
    print "Node not found"
    

def send_to_gallery(data,send):
    if send:
        json_data = dict()
    
        uid = str(Guid.NewGuid())
        json_data['params'] = data
        json_data['uid'] = uid
        json_data['cad_file'] = 'xyz.obj'
        json_data['image'] = uid+'.bmp'
    
        with open(path+uid+'.json','w') as outfile:
            json.dump(json_data, outfile, indent=2)
        
        bitmap = doc.Views.ActiveView.CaptureToBitmap(True, True, True)
        bitmap.Save(path+uid+'.bmp')
        print "Sent "+uid+" to gallery"





# Generate cart. prod. from new kernel and slowly send to gallery

# Read file
if trigger:
    if os.path.exists(path_kernel+'kernel.json'):
        f = open(path_kernel+'kernel.json','r')
        data = f.read()
        f.close()
        if len(data)>0:
            # parse the data into dict
            kernel = eval(data)
            #erase the file contents to prevent infinite loop
            f = open(path_kernel+'kernel.json','w')
            f.write('')
            f.close()
            
            _matrix = create_matrix(kernel)
            _cproduct = generate_cproduct(_matrix)
            
            #now iterate over _cproduct and update model
            #then wait for 1 sec and take snapshot, send to gall
            for i in range(0,3,1):
                _alt = get_alt(i , _cproduct, kernel)
                node = get_node("2"+node_name)
                update_model(_alt,node)
                gh.RunSolver("C:/Users/Arefin/Documents/hysteresis-server/public/hysteresis2.0.ghx")
                send_to_gallery(_alt, True)
# ---------- end kernel2product ----------

flux_2 = FluxProject(project="a9jAyvE70YL3qR5WZ")  # -> Keys, Meta
flow_control_2 = FlowControl({"Once", "Constantly"}, selected="Constantly")
send_to_gallery_2 = PythonScript(alt=magicbox.alt, dir=getdirectory.dir, cad_file=getdirectory.full_path, send=send_to_gallery)  # disabled
# ---------- send_to_gallery_2: Python ----------
from System import Guid
import json
from scriptcontext import doc
import os
#path = "C:/Users/Arefin/Documents/hysteresis-server/gallery/"
path = os.path.join(dir,"gallery"+os.sep)
print path
_alt = json.loads(alt)
def send_to_gallery(data):
    json_data = dict()

    uid = str(Guid.NewGuid())
    json_data['filepath'] = cad_file
    json_data['params'] = data
    json_data['uid'] = uid
    json_data['cad_file'] = 'xyz.obj'
    json_data['image'] = uid+'.bmp'

    with open(path+uid+'.json','w') as outfile:
        json.dump(json_data, outfile, indent=2)
    
    bitmap = doc.Views.ActiveView.CaptureToBitmap(True, True, True)
    bitmap.Save(path+uid+'.bmp')
    print "Sent "+uid+" to gallery"
    
if send:
    send_to_gallery(_alt)
# ---------- end send_to_gallery_2 ----------
serialize = PythonScript(input=magicbox.keys)  # -> output
# ---------- serialize: Python ----------
import cPickle
output = cPickle.dumps(input)
print output
print(type(output))
# ---------- end serialize ----------
serialize_2 = PythonScript(input=magicbox.matrix)  # -> output; same code as serialize
to_flux = ToFlux(Keys=flux_2.Keys, Value=serialize_2, Mode=flow_control_2, keyId="404722a83a22684e0079a179785efa64", mode="Constantly")
to_flux_2 = ToFlux(Keys=flux_2.Keys, Value=serialize, Mode=flow_control_2, keyId="40fc6dc0a9c8f0442f6624b91b6640f1", mode="Constantly")
to_flux_3 = ToFlux(Keys=flux_2.Keys, Value=magicbox.index, Mode=flow_control_2, keyId="40b8bce9d56129e52fe444d295fc9af4", mode="Constantly")
flux_3 = FluxProject(project="a9jAyvE70YL3qR5WZ")  # -> Keys, Meta
flow_control_3 = FlowControl({"Once", "Constantly"}, selected="Constantly")
from_flux_2 = FromFlux(
    Keys=flux_3.Keys,
    Mode=flow_control_3,
    keyId="404722a83a22684e0079a179785efa64",
    mode="Constantly",
    Branch0_Path="{0;0;0}",
    Branch0_Item0_null_string=False,
    Branch0_Item0_string="""(lp0
F8.0
aF3.0
a.""",
    Branch0_Item0_TypeName="Grasshopper.Kernel.Types.GH_String",
    Branch0_Item1_null_string=False,
    Branch0_Item1_string="""(lp0
F1.0
a.""",
    Branch0_Item1_TypeName="Grasshopper.Kernel.Types.GH_String",
    Branch0_Item2_null_string=False,
    Branch0_Item2_string="""(lp0
F0.90000000000000002
a.""",
    Branch0_Item2_TypeName="Grasshopper.Kernel.Types.GH_String",
    Branch0_Item3_null_string=False,
    Branch0_Item3_string="""(lp0
F1.0
a.""",
    Branch0_Item3_TypeName="Grasshopper.Kernel.Types.GH_String",
    Branch0_Item4_null_string=False,
    Branch0_Item4_string="""(lp0
F1.0
a.""",
    Branch0_Item4_TypeName="Grasshopper.Kernel.Types.GH_String",
    Branch0_Item5_null_string=False,
    Branch0_Item5_string="""(lp0
F8.0
a.""",
    Branch0_Item5_TypeName="Grasshopper.Kernel.Types.GH_String",
    Branch0_Item6_null_string=False,
    Branch0_Item6_string="""(lp0
F0.0
a.""",
    Branch0_Item6_TypeName="Grasshopper.Kernel.Types.GH_String",
    Branch0_Item7_null_string=False,
    Branch0_Item7_string="""(lp0
F6.0
a.""",
    Branch0_Item7_TypeName="Grasshopper.Kernel.Types.GH_String")  # -> Value, Meta
from_flux_3 = FromFlux(
    Keys=flux_3.Keys,
    Mode=flow_control_3,
    keyId="40fc6dc0a9c8f0442f6624b91b6640f1",
    mode="Constantly",
    Branch0_Path="{0;0;0}",
    Branch0_Item0_null_string=False,
    Branch0_Item0_string="""VOutputShape-seg
p0
.""",
    Branch0_Item0_TypeName="Grasshopper.Kernel.Types.GH_String",
    Branch0_Item1_null_string=False,
    Branch0_Item1_string="""VOutputShape
p0
.""",
    Branch0_Item1_TypeName="Grasshopper.Kernel.Types.GH_String",
    Branch0_Item2_null_string=False,
    Branch0_Item2_string="""VPointX
p0
.""",
    Branch0_Item2_TypeName="Grasshopper.Kernel.Types.GH_String",
    Branch0_Item3_null_string=False,
    Branch0_Item3_string="""VGridType
p0
.""",
    Branch0_Item3_TypeName="Grasshopper.Kernel.Types.GH_String",
    Branch0_Item4_null_string=False,
    Branch0_Item4_string="""VPointY
p0
.""",
    Branch0_Item4_TypeName="Grasshopper.Kernel.Types.GH_String",
    Branch0_Item5_null_string=False,
    Branch0_Item5_string="""VAngle
p0
.""",
    Branch0_Item5_TypeName="Grasshopper.Kernel.Types.GH_String",
    Branch0_Item6_null_string=False,
    Branch0_Item6_string="""VAttF(x)
p0
.""",
    Branch0_Item6_TypeName="Grasshopper.Kernel.Types.GH_String",
    Branch0_Item7_null_string=False,
    Branch0_Item7_string="""VScale
p0
.""",
    Branch0_Item7_TypeName="Grasshopper.Kernel.Types.GH_String")  # -> Value, Meta
from_flux_4 = FromFlux(
    Keys=flux_3.Keys,
    Mode=flow_control_3,
    keyId="40b8bce9d56129e52fe444d295fc9af4",
    mode="Constantly",
    Branch0_Path="{0;0}",
    Branch0_Item0_number=21,
    Branch0_Item0_TypeName="Grasshopper.Kernel.Types.GH_Integer")  # -> Value, Meta
deserialize = PythonScript(input=from_flux_2.Value)  # -> output
# ---------- deserialize: Python ----------
import cPickle
output = cPickle.loads(input)
print output
print(type(output))
# ---------- end deserialize ----------
deserialize_2 = PythonScript(input=from_flux_3.Value)  # -> output; same code as deserialize
panel_2 = Panel(deserialize_2)
tree2list = PythonScript(intree=deserialize)  # -> outlist; inputs intree: tree
# ---------- tree2list: Python ----------
myList=[]
for i in range(intree.BranchCount):
    arr1 = []
    for j in range(len(intree.Branch(i))):
        arr1.append(intree.Branch(i)[j])
    myList.append(arr1)
    
outlist = myList
print outlist
# ---------- end tree2list ----------
cartesianproduct = PythonScript(kernel=tree2list)  # -> cproduct; inputs kernel: list
# ---------- cartesianproduct: Python ----------
import itertools
import cPickle

def generate_cproduct(matrix):
    #cartesian product
    product = []
    for item in itertools.product(*matrix):
        product.append(item)
    return product

cproduct = generate_cproduct(kernel)
print kernel
# ---------- end cartesianproduct ----------
selector = PythonScript(input=cartesianproduct, keys=deserialize_2, index=from_flux_4.Value)  # -> out, a; inputs input: list, keys: list
# ---------- selector: Python ----------
def get_alt(index, productlist,keys):
    i = int(index)%(len(productlist)) 
    selection = productlist[i]    
    rvec = dict()    
    nkeylist = []
    for key in keys:
        nkeylist.append(key)
    for key,value in zip(nkeylist,selection):
        rvec[key] = value
    return rvec

def update_model(rvec, node):
    for input in node.Params.Input:
        value = rvec[input.NickName]
        input.Sources[0].Slider.Value = value
    node.ExpireSolution(True)
    print "Updated "+node.NickName
    
def get_node(name):
    ghObjects = ghenv.Component.OnPingDocument().Objects
    for obj in ghObjects:
        if obj.NickName == name:
            return obj
    print "Node not found"
    
node = get_node("2ReactorGen")
_alt = get_alt(index, input, keys)
update_model(_alt, node)
print index, _alt
# ---------- end selector ----------
panel_3 = Panel(selector.out)

# ==== cluster ReactorGen
A = ClusterInput()
A_2 = ClusterInput()
hexgrid = Hexagonal(Plane=PlaneXY(0, 0, 0), Size=8, ExtentX=10, ExtentY=8)  # -> Cells, Points
sqgrid = Square(Plane=PlaneXY(0, 0, 0), Size=10, ExtentX=10, ExtentY=10)  # -> Cells, Points
trigrid = Triangular(Plane=PlaneXY(0, 0, 0), Size=10, ExtentX=20, ExtentY=12)  # -> Cells, Points
radgrid = Radial(Plane=PlaneXY(50, 50, 0), Size=5, ExtentR=10, ExtentP=20)  # -> Cells, Points
pop2d = Populate2D(Region={Plane=PlaneXY(0, 0, 0), Size=Domain2(u=0..100, v=0..100)}, Count=100, Seed=1)
G = ClusterInput()
scaleup = Multiplication(A=A, B=100)
scaleup_2 = Multiplication(A=A_2, B=100)
pt = ConstructPoint(XCoordinate=scaleup, YCoordinate=scaleup_2, ZCoordinate=0)
gridtype = StreamFilter(Gate=G, Stream0=pop2d, Stream1=radgrid.Points, Stream2=trigrid.Points, Stream3=hexgrid.Points, Stream4=sqgrid.Points)
pt_2 = Point(pt)
linept_grid = Line(StartPoint=gridtype, EndPoint=pt_2)
G_2 = ClusterInput()
f_x_chooser = StreamFilter(Gate=G_2, Stream0="x/2", Stream1="x", Stream2="x*sin(x)")
len = Length(Curve=linept_grid)
B = ClusterInput()
eval = Evaluate(F=f_x_chooser, x=len)
scaledown = Division(A=eval, B=B)
A_3 = ClusterInput()
G_3 = ClusterInput()
outputtype = StreamGate(Stream=gridtype, Gate=G_3)  # -> Target0, Target1
S = ClusterInput()
circle = CircleCNR(Center=outputtype.Target0, Normal=Vector(0, 0, 1), Radius=scaledown)
polygon = Polygon(Plane=outputtype.Target1, Radius=scaledown, Segments=S, FilletRadius=0)  # -> Polygon, Length
rotate = Rotate(Geometry=polygon.Polygon, Angle=A_3, Plane=outputtype.Target1)  # -> Geometry, Transform
merge = Merge(Data1=circle, Data2=rotate.Geometry)
R = ClusterOutput(merge)

# ==== cluster HystEng20
path = ClusterInput()
txt = ClusterInput()
path_2 = FilePath(path)
record = ClusterInput()
txt_2 = Text(txt)
file = ClusterInput()
data_grabber = PythonScript(node_name=txt_2, path=path_2, record=record)  # inputs record: Boolean
# ---------- data_grabber: Python ----------
import Grasshopper as gh
import os

ghObjects = ghenv.Component.OnPingDocument().Objects
d = dict()
key_list = []
if record:
    for obj in ghObjects:
        if obj.NickName == node_name.ToString():
            value_list = []
            for input in obj.Params.Input:
                if input.Sources[0].NickName:
                    key = input.Sources[0].NickName
                else:
                    input.Sources[0].NickName = input.NickName
                    key = input.Sources[0].NickName
                value = input.Sources[0].Slider.Value.ToDouble(input.Sources[0].Slider.Value)
                d[key] = value
                value_list.append(value)
    if len(d)>0:
#        d_vector = value_list
        print d
        if os.path.exists(path):
            f = open(path,'a')
            f.write(str(d))
            f.write('\n')
        else:
            f = open(path,'w')
            f.write(str(d))
            f.write('\n')
        f.close()
 
            
        
#for obj in ghObjects:
#    if obj.NickName == node_name.ToString():
#        value_list = []
#        for input in obj.Params.Input:
#            key_list.append(input.NickName)
#
#length = int(len(key_list))
# ---------- end data_grabber ----------
file_2 = ReadFile(F=path_2, PerLineParse=True)  # -> C
#   port F: Uri of file to read
# ---------- file_2: VB line parser ----------
    action = GH_LineParserAction.Include
    Return line

    'Parse the line and return some data that represents the line.
    'If the line cannot be parsed, you can return Nothing and
    'assign a different action.
    'The default implementation is to just return the line itself.
    'If you return types that implement IGH_Goo, this component
    'will work substantially faster.
# ---------- end file_2 ----------
restore_state = PythonScript(file=file, node_name=txt_2)
# ---------- restore_state: Python ----------
import json
state = json.loads(file)

ghObjects = ghenv.Component.OnPingDocument().Objects
for obj in ghObjects:
    if obj.NickName == node_name:
        for input in obj.Params.Input:
            value = state['params'][input.NickName]
            input.Sources[0].Slider.Value = value
        obj.ExpireSolution(True)
# ---------- end restore_state ----------
send = ClusterInput()
index = ClusterInput()
magicbox = PythonScript(node_name=txt_2, data=simplify(file_2), send=send, index=index)  # inputs data: list
# ---------- magicbox: Python ----------
import json
import itertools
import Grasshopper as gh
from System import Guid
from scriptcontext import doc


path = "C:/Users/Arefin/Desktop/auto_slider/dump/"
def chunks(l, n):
    """Yield successive n-sized chunks from l."""
    for i in xrange(0, len(l), n):
        yield l[i:i+n]
        
veclist = []
keylist = []
valuelist = []
#print data
# turn strings into dicts
for item in data:
    vec = eval(item)
    veclist.append(vec)

flip_dict = dict()    
# get the names of keys to iterate over 
for vec in veclist:   
    for key in vec:
        flip_dict[key] = []

#accumulate
for key in flip_dict:
    for vec in veclist:
        if key in vec:
            flip_dict[key].append(vec[key])

#create matrix 
matrix = []       
for key in flip_dict:
    matrix.append(set(flip_dict[key]))
    
#cartesian product
product = []
for item in itertools.product(*matrix):
    product.append(item)

i = int(index)%(len(product)) 
selection = product[i]

rvec = dict()

nkeylist = []
for key in flip_dict:
    nkeylist.append(key)
for key,value in zip(nkeylist,selection):
    rvec[key] = value
    
# grab duplicate node and set sliders
d_node_name = '2'+node_name    

ghObjects = ghenv.Component.OnPingDocument().Objects
for obj in ghObjects:
    if obj.NickName == d_node_name:
        for input in obj.Params.Input:
            value = rvec[input.NickName]
            input.Sources[0].Slider.Value = value
        obj.ExpireSolution(True)    
if send:
    json_data = dict()

    uid = str(Guid.NewGuid())
    json_data['params'] = rvec
    json_data['uid'] = uid
    json_data['cad_file'] = 'xyz.obj'
    json_data['image'] = path+uid+'.bmp'

    with open(path+uid+'.json','w') as outfile:
        json.dump(json_data, outfile, indent=2)
    
    bitmap = doc.Views.ActiveView.CaptureToBitmap(True, True, True)
    bitmap.Save(path+uid+'.bmp')
# ---------- end magicbox ----------
