# Grasshopper definition reactor_gh.ghx (Grasshopper 0.9.76)
# Copyright: 2016
# plug-ins: Python Interpreter

outputshape_seg = Slider(3, range=3..8)
number_slider = Slider(1, range=0..1)
gridtype = Slider(2, range=0..4)
scale = Slider(10, range=1..15)
number_slider_2 = Slider(0.5, range=0..1)
attf_x = Slider(0, range=0..2)
number_slider_3 = Slider(45, range=0..100)
outputshape = Slider(1, range=0..1)
reactorgen = ReactorGen(
    G=gridtype,
    G_2=attf_x,
    G_3=outputshape,
    S=outputshape_seg,
    A=number_slider_2,
    A_2=number_slider,
    B=scale,
    A_3=number_slider_3)
geo = Geometry(reactorgen)
path = FilePath("C:\Users\Arefin\Documents\Hysteresis\reactor_gh.ghx")
xml_parser = PythonScript(file_path=path)  # -> out, a
# ---------- xml_parser: Python ----------
# (c)2016 Design Alternatives Group, SIAT, Simon Fraser University
# 8888 University Dr, Burnaby, BC V5A 1S6


from collections import defaultdict
import xml.etree.ElementTree as ET 
tree = ET.parse(file_path)
val = tree.find('.//chunk[@name="DefinitionProperties"]')

full_dict = defaultdict(dict)
state_dict = defaultdict(dict)

state_chunk = tree.find('.//chunk[@name="StateServer"]')
state_count = state_chunk.find('.//item[@name="StateCount"]')

state_names = state_chunk.findall('.//item[@name="Name"]')
counter = 0
for state_name in state_names:
	state_dict[("state-"+str(counter))]["state_name"]=state_name.text
	counter+=1

states = state_chunk.findall('.//chunk[@name="State"]')
state_list = []
for state in states:
	state_list.append(state.findall('.//item[@name="Value"]'))

for state,key in zip(state_list, state_dict):
	state_dict[key]["params"]=[]
	for param in state:
		state_dict[key]["params"].append(int(param.text))

file_name = val.find('.//item[@name="Name"]')
full_dict["file_name"]=file_name.text
full_dict["states"] = state_dict
print full_dict
# ---------- end xml_parser ----------
file = ReadFile(File="C:\School\School\GH\Hysteresis\results\recordedAlts_uf.csv", PerLineParse=True)
panel = Panel(file)
python = PythonScript()  # -> out, a
# ---------- python: Python ----------
import sys
for folder in sys.path:
    print folder
import xml.etree.ElementTree as ET 
print ET
# ---------- end python ----------
csvwriter_flipped = PythonScript()  # -> out, a; inputs x: tree
# ---------- csvwriter_flipped: Python ----------
import os

filename = "C:/School/School/GH/Hysteresis/results/recordedAlts.csv"
#if os.path.exists(filename):
#    file=csv.reader(open(filename, 'rb'))
#    print file
#else:
#    spamWriter = csv.writer(open('eggs.csv', 'wb'))
#    spamWriter.writerow(['Spam']*5+['Baked Beans'])
#    spamWriter.writerow(['Spam', 'Lovely Spam','Wonderful Spam'])

if os.path.exists(filename):
    file = open(filename,'w')
    for i in range(x.BranchCount):
        row = 'param'+str(i)
        for j in range(len(x.Branch(i))):
            row = row +','+ str(x.Branch(i)[j])
            finalrow = row + '\n'
            file.write(finalrow)
    
            file.close()
# ---------- end csvwriter_flipped ----------
panel_2 = Panel("WIP. Ignore now")
send_to_gallery = Button()
file_2 = ReadFile(F="C:\School\School\GH\Hysteresis\results\5e8f6e22-da08-4b70-af33-117922a278a5.json", PerLineParse=False)  # -> C
#   port F: Uri of file to read
# ---------- file_2: VB line parser ----------
    action = GH_LineParserAction.Include
    Return line

    'Parse the line and return some data that represents the line.
    'If the line cannot be parsed, you can return Nothing and
    'assign a different action.
    'The default implementation is to just return the line itself.
    'If you return types that implement IGH_Goo, this component
    'will work substantially faster.
# ---------- end file_2 ----------
path_2 = FilePath("C:\School\School\GH\Hysteresis\results\trail.txt")
csvreader = PythonScript()  # -> out, pt, alt
# ---------- csvreader: Python ----------
import os
import rhinoscriptsyntax as rs
import re

filename = "C:/School/School/GH/Hysteresis/results/recordedAlts_uf.csv"
file = open(filename,'r')
lines = file.readlines()
file.close()

matrix = []
for line in lines:
    line = line.strip()
    params = line.split(',')
    matrix.append(params)
print matrix

str1 = (matrix[1][4])
pt = rs.coerceguid(str1)

alt = [float(matrix[1][0]),float(matrix[1][1]),float(matrix[1][2]),float(matrix[1][3]),pt,float(matrix[1][5]),float(matrix[1][6])]
# ---------- end csvreader ----------
geo_2 = Geometry(csvreader.pt)
panel_3 = Panel("For debugging")
fileout = FileOut()
hysteresis_engine = HysteresisEngine(i=0)  # -> data_4, S
number_slider_4 = Slider(0, range=0..100000)
number_slider_5 = Slider(5, range=0..5)

series = Series(Start=0, Step=1, Count=10)
item = TreeItem(Path=series, Index=Slider(0, range=0..100), Wrap=True)
dpath = DeconstructPath(Branch=item)
data = Data(item)
panel_4 = Panel(dpath)
panel_5 = Panel(item)

python_2 = PythonScript(x=Button())  # -> out, a
# ---------- python_2: Python ----------
from scriptcontext import doc
from System.Windows.Forms import *
import Rhino.UI
from System import Environment
 
def RunCommand():
  file_name = "";
 
  bitmap = doc.Views.ActiveView.CaptureToBitmap(True, True, True)
 
  # copy bitmap to clipboard
  Clipboard.SetImage(bitmap)
 
 
#   save bitmap to file
  save_file_dialog = Rhino.UI.SaveFileDialog()
  save_file_dialog.Filter = "*.bmp"
  save_file_dialog.InitialDirectory = \
    Environment.GetFolderPath(Environment.SpecialFolder.MyDocuments)
 
  if save_file_dialog.ShowDialog() == DialogResult.OK:
    file_name = save_file_dialog.FileName
 
  if file_name != "":
    bitmap.Save(file_name)

  bitmap.Save("002.bmp")
 
  return Rhino.Commands.Result.Success
 
if __name__ == "__main__":
  if x:
    RunCommand()
# ---------- end python_2 ----------
button = Button()
python_3 = PythonScript()  # -> out, alt; inputs x: tree
# ---------- python_3: Python ----------
import itertools
import collections
compare = lambda a,b: collections.Counter(a) == collections.Counter(b)
recordedAlts = []
currentAlt = []

if(y):
    for i in range(x.BranchCount):
        currentAlt.append(x.Branch(i))
    for j in range(len(recordedAlts)):
        if(compare(currentAlt,recordedAlts[j])):
            break
        recordedAlts.append(currentAlt)

print currentAlt
print recordedAlts

altProduct = []

for item in itertools.product(*recordedAlts):
    altProduct.append(item)
    
if(len(altProduct)>0):
    index = int(z) % len(altProduct)
    alt = altProduct[index]
    
print altProduct
# ---------- end python_3 ----------
panel_6 = Panel(python_3.out)
panel_7 = Panel("OLD STUFF")
hysteresisengine = HysteresisEngine_2()  # -> alt, S
python_4 = PythonScript()  # -> out, alt; inputs x: tree
# ---------- python_4: Python ----------
import itertools
import collections
compare = lambda x,y: collections.Counter(x) == collections.Counter(y)
#somelists = [[1,2,3],['a','b']]
#
#for item in itertools.product(*somelists):
#    print item
if (x.BranchCount>0):
    listOfLists = []
    for i in range(x.BranchCount):
        listOfLists.append(x.Branch(i))
    
    listProduct = []
    for item in itertools.product(*listOfLists):
        if (len(listProduct)>0):
            for i in listProduct:
                if(compare(item,i)):
                    break
                else:                    
                    listProduct.append(item)
                    
    alt = listProduct[int(y)]
    n = len(listProduct)
    print "Number of alternatives saved :", len(x.Branch(i))
    print "Number of hysterical :", n
    print "Displaying alternative number :", int(y)
else:
    print "No alternatives saved"    
print 5%3
# ---------- end python_4 ----------

params = Merge(
    Data1=gridtype,
    Data2=attf_x,
    Data3=outputshape,
    Data4=outputshape_seg,
    Data5=number_slider_2,
    Data6=number_slider,
    Data7=scale,
    Data8=number_slider_3)
dam = DataDam(DataRECORD=params, BufferDelay=10000000, BufferMode=0)
knob = ControlKnob(Decimals=0, Limit=False, Maximum=10, Minimum=0, Range=5, Value=27)

data_2 = Data(dam)
lng = ListLength(List=data_2)
rec = DataRecorder(data_2, DataLimit=-10, RecordData=True)
partition = PartitionList(List=rec, Size=lng)
# This is not explicitly needed
split = SplitTree(Data=partition, Masks=flatten("{?;?}"))  # -> Positive, Negative
flip = FlipMatrix(Data=split.Positive)
series_2 = Series(Start=0, Step=1, Count=lng)
simplify = SimplifyTree(Tree=flip, Front=False)
panel_8 = Panel(simplify)
crossproduct = PythonScript(currentAlt=simplify, index=knob, send=send_to_gallery, path=path_2, input=file_2)  # -> out, alt, capture, bmp_path; inputs currentAlt: tree
# ---------- crossproduct: Python ----------
import itertools
import json
from System import Guid
import os.path
#The best py library ever

recordedAlts = []

for i in range(currentAlt.BranchCount):
    recordedAlts.append(list(set(currentAlt.Branch(i))))
    
for i in recordedAlts:
    i.sort()
print recordedAlts
#delete the annoying 1st item by pushing to tempList
#tempList = []
#for i in range(len(recordedAlts)):
#    l = list(recordedAlts[i]) #<-- recast as list
#    l.pop(0)
#    tempList.append(l)

#clean recorded alts by removing duplicates

#recordedAlts.sort()
#recordedAltsClean = list(recordedAlts for recordedAlts, _ in itertools.groupby(recordedAlts))


#make product
hystProduct = []

for item in itertools.product(*recordedAlts):
    hystProduct.append(item)
        
#clean hysteresis

#hystProduct.sort()
#hystProductClean = list(hystProduct for hystProduct, _ in itertools.groupby(hystProduct))

if(len(hystProduct)>0):
    i = int(index)%(len(hystProduct))
    alt = list(hystProduct[i])
    


gallery = []

# Find in which indices the parameters of alt occur, and length of that array
#for i in alt:
#    index = recordedAltsClean[i].index(alt[i])
#    print index


#print "Alts rec :", len(recordedAlts)," Alts after cleaning :",len(recordedAltsClean)
print "Product full :", len(hystProduct), " Products ", hystProduct
#print alt

path_dir = 'C:/Users/Arefin/Documents/Hysteresis/json'
if send:
    myguid = Guid.NewGuid()
    myguid_str = myguid.ToString('D')

    indices =[]
    lengths = []
    for i in range(len(alt)):
        temp = list(recordedAlts[i])
        indices.append(temp.index(alt[i]))
        lengths.append(len(temp))
    filename=myguid_str+".json"
    filename_bmp = myguid_str+".bmp"
    full_path_bmp = os.path.join(path_dir,filename_bmp)
    bmp_path = full_path_bmp
    data = {'uid':myguid_str,'image':'json/'+filename_bmp,'cad_file': path_dir, 'param_indices':indices}
    capture = True
    full_path = os.path.join(path_dir,filename)
    with open(full_path,'w') as outfile:
        json.dump(data, outfile, indent=2)
# ---------- end crossproduct ----------

csvwriter = PythonScript(x=data_2)  # -> out, a; inputs x: tree
# ---------- csvwriter: Python ----------
import os

filename = "C:/School/School/GH/Hysteresis/results/recordedAlts_uf.csv"
#if os.path.exists(filename):
#    file=csv.reader(open(filename, 'rb'))
#    print file
#else:
#    spamWriter = csv.writer(open('eggs.csv', 'wb'))
#    spamWriter.writerow(['Spam']*5+['Baked Beans'])
#    spamWriter.writerow(['Spam', 'Lovely Spam','Wonderful Spam'])

if True:
    if not os.path.exists(filename):
        file = open(filename,'w')
#    header = str(type(x.Branch(0)[0]))+','
#    for i in range(1,len(x.Branch(0))):
#        header = header+str(type((x.Branch(0)[i])))
#        if not i==len(x.Branch(0)):
#            header = header+','
#    header = header+'\n'
#    file.write(header)
        
        for i in range(x.BranchCount):
            row = str(x.Branch(i)[0])+','
            for j in range(1,len(x.Branch(i))):
                row = row + str(x.Branch(i)[j])
                if not j==len(x.Branch(i))-1:
                    row = row + ','
            finalrow = row + '\n'
            file.write(finalrow)
        file.close()
    else:
        file = open(filename,'a')
        for i in range(x.BranchCount):
            row = str(x.Branch(i)[0])+','
            for j in range(1,len(x.Branch(i))):
                row = row + str(x.Branch(i)[j])
                if not j==len(x.Branch(i))-1:
                    row = row + ','
            finalrow = row + '\n'
            file.write(finalrow)
        file.close()
# ---------- end csvwriter ----------
simplify_2 = SimplifyTree(Tree=split.Positive, Front=False)
panel_9 = Panel(crossproduct.out)
captureimg = PythonScript(capture=crossproduct.capture, bmp_path=crossproduct.bmp_path)  # -> out
# ---------- captureimg: Python ----------
from scriptcontext import doc
if capture:
    bitmap = doc.Views.ActiveView.CaptureToBitmap(True, True, True)
    bitmap.Save(bmp_path)
# ---------- end captureimg ----------

sift = SiftPattern(List=crossproduct.alt, SiftPattern=series_2)  # -> Output0, Output1, Output2, Output3, Output4, Output5, Output6, Output7
clean = CleanTree(RemoveNulls=True, RemoveInvalid=True, RemoveEmpty=False, Tree=sift.Output7)

clean_2 = CleanTree(RemoveNulls=True, RemoveInvalid=True, RemoveEmpty=False, Tree=sift.Output0)
clean_3 = CleanTree(RemoveNulls=True, RemoveInvalid=True, RemoveEmpty=False, Tree=sift.Output1)
clean_4 = CleanTree(RemoveNulls=True, RemoveInvalid=True, RemoveEmpty=False, Tree=sift.Output3)
clean_5 = CleanTree(RemoveNulls=True, RemoveInvalid=True, RemoveEmpty=False, Tree=sift.Output2)
clean_6 = CleanTree(RemoveNulls=True, RemoveInvalid=True, RemoveEmpty=False, Tree=sift.Output4)
clean_7 = CleanTree(RemoveNulls=True, RemoveInvalid=True, RemoveEmpty=False, Tree=sift.Output5)
clean_8 = CleanTree(RemoveNulls=True, RemoveInvalid=True, RemoveEmpty=False, Tree=sift.Output6)

reactorgen_2 = ReactorGen(G=clean_2, G_2=clean_3, G_3=clean_5, S=clean_4, A=clean_6, A_2=clean_7, B=clean_8, A_3=clean)
move = Move(Geometry=reactorgen_2, Motion=Vector(189, 0, 0))  # -> Geometry, Transform

# ==== cluster ReactorGen
A = ClusterInput()
A_2 = ClusterInput()
hexgrid = Hexagonal(Plane=PlaneXY(0, 0, 0), Size=8, ExtentX=10, ExtentY=8)  # -> Cells, Points
sqgrid = Square(Plane=PlaneXY(0, 0, 0), Size=10, ExtentX=10, ExtentY=10)  # -> Cells, Points
radgrid = Radial(Plane=PlaneXY(50, 50, 0), Size=5, ExtentR=10, ExtentP=20)  # -> Cells, Points
trigrid = Triangular(Plane=PlaneXY(0, 0, 0), Size=10, ExtentX=20, ExtentY=12)  # -> Cells, Points
pop2d = Populate2D(Region={Plane=PlaneXY(0, 0, 0), Size=Domain2(u=0..100, v=0..100)}, Count=100, Seed=1)
G = ClusterInput()
scaleup = Multiplication(A=A, B=100)
scaleup_2 = Multiplication(A=A_2, B=100)
pt = ConstructPoint(XCoordinate=scaleup, YCoordinate=scaleup_2, ZCoordinate=0)
gridtype = StreamFilter(Gate=G, Stream0=pop2d, Stream1=radgrid.Points, Stream2=trigrid.Points, Stream3=hexgrid.Points, Stream4=sqgrid.Points)
pt_2 = Point(pt)
linept_grid = Line(StartPoint=gridtype, EndPoint=pt_2)
G_2 = ClusterInput()
f_x_chooser = StreamFilter(Gate=G_2, Stream0="x/2", Stream1="x", Stream2="x*sin(x)")
len = Length(Curve=linept_grid)
B = ClusterInput()
eval = Evaluate(F=f_x_chooser, x=len)
scaledown = Division(A=eval, B=B)
A_3 = ClusterInput()
G_3 = ClusterInput()
outputtype = StreamGate(Stream=gridtype, Gate=G_3)  # -> Target0, Target1
S = ClusterInput()
circle = CircleCNR(Center=outputtype.Target0, Normal=Vector(0, 0, 1), Radius=scaledown)
polygon = Polygon(Plane=outputtype.Target1, Radius=scaledown, Segments=S, FilletRadius=0)  # -> Polygon, Length
rotate = Rotate(Geometry=polygon.Polygon, Angle=A_3, Plane=outputtype.Target1)  # -> Geometry, Transform
merge = Merge(Data1=circle, Data2=rotate.Geometry)
R = ClusterOutput(merge)

# ==== cluster HysteresisEngine
data = ClusterInput()
data_2 = Data(data)
lng = ListLength(List=data_2)
rec = DataRecorder(data_2, DataLimit=-10, RecordData=True)
partition = PartitionList(List=rec, Size=lng)
flip = FlipMatrix(Data=partition)
series = Series(Start=0, Step=1, Count=lng)
S = ClusterOutput(series)
simplify = SimplifyTree(Tree=flip, Front=False)
panel = Panel(flip)
viewer = ParamViewer(simplify)
i = ClusterInput()
item = TreeItem(Tree=simplify, Path=series, Index=i, Wrap=True)
panel_2 = Panel(item)
data_3 = Data(item)
data_4 = ClusterOutput(data_3)

# ==== cluster HysteresisEngine_2
data = ClusterInput()
index = ClusterInput()

data_2 = Data(data)
lng = ListLength(List=data_2)
rec = DataRecorder(data_2, DataLimit=-10, RecordData=True)
partition = PartitionList(List=rec, Size=lng)
split = SplitTree(Data=partition, Masks=flatten("{?;?}"))  # -> Positive, Negative
series = Series(Start=0, Step=1, Count=lng)
flip = FlipMatrix(Data=split.Positive)
simplify = SimplifyTree(Tree=flip, Front=False)
python = PythonScript(currentAlt=simplify, index=index)  # -> out, alt; inputs currentAlt: tree
# ---------- python: Python ----------
import itertools
#The best py library ever

recordedAlts = []

for i in range(currentAlt.BranchCount):
    recordedAlts.append((currentAlt.Branch(i)))
    
#delete the annoying 1st item by pushing to tempList
#tempList = []
#for i in range(len(recordedAlts)):
#    l = list(recordedAlts[i]) #<-- recast as list
#    l.pop(0)
#    tempList.append(l)

#clean recorded alts by removing duplicates

recordedAlts.sort()

recordedAltsClean = list(recordedAlts for recordedAlts, _ in itertools.groupby(recordedAlts))

#make product
hystProduct = []

for item in itertools.product(*recordedAltsClean):
    hystProduct.append(item)
    
#for item in itertools.product(*recordedAlts):
#    hystProduct.append(item)
    
#clean hysteresis

hystProduct.sort()
hystProductClean = list(hystProduct for hystProduct, _ in itertools.groupby(hystProduct))

if(len(hystProductClean)>0):
    i = int(index)%(len(hystProductClean))
    alt = hystProductClean[i]
    
#if(len(hystProduct)>0):
#    i = int(index)%(len(hystProduct))
#    alt = hystProduct[i]

print len(recordedAlts)
print len(recordedAltsClean)
print len(hystProduct)
# ---------- end python ----------
viewer = ParamViewer(simplify)
panel = Panel(flip)

S = ClusterOutput(series)
alt = ClusterOutput(python.alt)

# ==== cluster FileOut
T = ClusterInput()
join = TextJoin(Text=T, Join=",")
c_script = CSharpScript(file="C:\School\School\GH\Hysteresis\results\test.csv", data=join, append=Toggle(True), enable=Toggle(True))  # -> out, A; inputs file: String, data: String, append: Boolean, enable: Boolean
# ---------- c_script: C# ----------
    if (!enable)
      return;

    if (data == null)
      return;

    if (append)
      System.IO.File.AppendAllText(file, data + Environment.NewLine);
    else
      System.IO.File.WriteAllText(file, data);
# ---------- end c_script ----------
